# Grasshopper definition v1.6.gh (Grasshopper 0.9.76)

# ----
# 绿地绘制辅助线
# 外轮廓退1m线
建筑外轮廓 = Curve([<curve referenced from the Rhino model> x109])
num = Number(1)
neg = Negative(Value=num)
vec = VectorXYZ(XComponent=num, YComponent=num, ZComponent=0)  # -> Vector, Length
vec_2 = VectorXYZ(XComponent=num, YComponent=neg, ZComponent=0)  # -> Vector, Length
vec_3 = VectorXYZ(XComponent=neg, YComponent=num, ZComponent=0)  # -> Vector, Length
vec_4 = VectorXYZ(XComponent=neg, YComponent=neg, ZComponent=0)  # -> Vector, Length
extr = Extrude(Base=建筑外轮廓, Direction=vec.Vector)
extr_2 = Extrude(Base=建筑外轮廓, Direction=vec_2.Vector)
extr_3 = Extrude(Base=建筑外轮廓, Direction=vec_3.Vector)
extr_4 = Extrude(Base=建筑外轮廓, Direction=vec_4.Vector)

消防登高场地 = Curve([<curve referenced from the Rhino model> x10])
boundary = BoundarySurfaces(Edges=消防登高场地)
brep = Brep(boundary)
preview = CustomPreview(Geometry=brep, Shader=ColourSwatch(SwatchColor=RGB(255, 255, 255)))

# ----
# 海绵城市设计指标（现状）
# 若为红色，则输入内容包含回车，需要删除
用地面积_m2 = Panel("62414")
回车检测 = Number(用地面积_m2)
年径流总量控制率 = Panel("75")
回车检测_2 = Number(年径流总量控制率)
设计降雨量_mm = Panel("24.4")
回车检测_3 = Number(设计降雨量_mm)

用地红线 = Curve([<curve referenced from the Rhino model> x2])
boundary_2 = BoundarySurfaces(Edges=用地红线)

# ----
# 径流系数
硬质屋面 = Panel("0.85")
绿化屋面 = Panel("0.5")
硬质铺装 = Panel("0.85")
透水铺装 = Panel("0.2")
生态停车位 = Panel("0.36")
道路 = Panel("0.85")
普通绿地 = Panel("0.15")
水面 = Panel("1")
下凹绿地 = Panel("0.15")
植草沟 = Panel("0.15")
雨水花园 = Panel("0.15")
生物滞留设施 = Panel("0.15")
merge = Merge(
    Data1=硬质屋面,
    Data2=绿化屋面,
    Data3=硬质铺装,
    Data4=透水铺装,
    Data5=生态停车位,
    Data6=道路,
    Data7=普通绿地,
    Data8=水面,
    Data9=下凹绿地,
    Data10=植草沟,
    Data11=雨水花园,
    Data12=生物滞留设施)

汇水分区2 = Curve(<curve referenced from the Rhino model>)
汇水分区3 = Curve(<curve referenced from the Rhino model>)
汇水分区5 = Curve()
汇水分区1 = Curve(<curve referenced from the Rhino model>)
汇水分区4 = Curve(<curve referenced from the Rhino model>)

# ----
# 设计前
# 轮廓线
# 下垫面类型
# 轮廓线
# 下垫面类型
# 轮廓线
# 下垫面类型
# 轮廓线
# 下垫面类型
# 轮廓线
# 下垫面类型
# 绿地轮廓线包含园路，
# 计算时自动扣除
# 轮廓线
# 下垫面类型
# 轮廓线
# 下垫面类型
# 轮廓线
# 下垫面类型
# 轮廓线
# 下垫面类型
硬质屋面_2 = Curve([<curve referenced from the Rhino model> x31])
list = ValueList({"硬质屋面": 0}, selected="硬质屋面")
list_2 = ValueList({"硬质屋面": 0, "绿化屋面": 1}, selected="绿化屋面")
道路_2 = Curve([<curve referenced from the Rhino model> x4])
list_3 = ValueList({"道路": 5}, selected="道路")
机动车停车位 = Curve([<curve referenced from the Rhino model> x9])
list_4 = ValueList({"硬质铺装": 2, "透水铺装": 3, "生态停车位": 4}, selected="硬质铺装")
非机动车停车位 = Curve([<curve referenced from the Rhino model> x7])
list_5 = ValueList({"硬质铺装": 2, "透水铺装": 3, "生态停车位": 4}, selected="硬质铺装")
绿地 = Curve([<curve referenced from the Rhino model> x36])
list_6 = ValueList({"普通绿地": 6}, selected="普通绿地")
园路 = Curve([<curve referenced from the Rhino model> x70])
list_7 = ValueList({"硬质铺装": 2, "透水铺装": 3}, selected="硬质铺装")
活动广场 = Curve([<curve referenced from the Rhino model> x11])
list_8 = ValueList({"硬质铺装": 2, "透水铺装": 3}, selected="硬质铺装")
水面_2 = Curve()
list_9 = ValueList({"水面": 7}, selected="水面")
绿化屋面_2 = Curve()

area = Area(Geometry=boundary_2)  # -> Area, Centroid
ma = MassAddition(Input=area.Area)  # -> Result, PartialResults

# ----
# 设计后
# 轮廓线不变，更改下垫面类型
# 轮廓线
# 下垫面类型
# 轮廓线
# 下垫面类型
# 轮廓线
# 下垫面类型
# 轮廓线
# 下垫面类型
# 轮廓线
# 下垫面类型
# 轮廓线
# 下垫面类型
# 轮廓线
# 下垫面类型
# 轮廓线
# 下垫面类型
# 轮廓线
# 下垫面类型
硬质屋面_3 = Curve(硬质屋面_2)
list_10 = ValueList({"硬质屋面": 0}, selected="硬质屋面")
list_11 = ValueList({"硬质屋面": 0, "绿化屋面": 1}, selected="硬质屋面")
道路_3 = Curve(道路_2)
list_12 = ValueList({"道路": 5}, selected="道路")
机动车停车位_2 = Curve(机动车停车位)
list_13 = ValueList({"硬质铺装": 2, "透水铺装": 3, "生态停车位": 4}, selected="透水铺装")
非机动车停车位_2 = Curve(非机动车停车位)
list_14 = ValueList({"硬质铺装": 2, "透水铺装": 3, "生态停车位": 4}, selected="透水铺装")
绿地_2 = Curve(绿地)
list_15 = ValueList({"普通绿地": 6}, selected="普通绿地")
园路_2 = Curve(园路)
list_16 = ValueList({"硬质铺装": 2, "透水铺装": 3}, selected="硬质铺装")
活动广场_2 = Curve(活动广场)
list_17 = ValueList({"硬质铺装": 2, "透水铺装": 3}, selected="硬质铺装")
水面_3 = Curve(水面_2)
list_18 = ValueList({"水面": 7}, selected="水面")
绿化屋面_3 = Curve(绿化屋面_2)

# ----
# 新增LID轮廓线
# 下垫面类型
# 新增LID轮廓线
# 下垫面类型
# 新增LID轮廓线
# 下垫面类型
# 新增LID轮廓线
# 下垫面类型
list_19 = ValueList({"下凹绿地": 8, "植草沟": 9, "雨水花园": 10, "生物滞留设施": 11}, selected="下凹绿地")
下凹绿地_2 = Curve([<curve referenced from the Rhino model> x45])
list_20 = ValueList({"植草沟": 9}, selected="植草沟")
生物滞留设施_2 = Curve()
list_21 = ValueList({"生物滞留设施": 11}, selected="生物滞留设施")
植草沟_2 = Curve()
list_22 = ValueList({"雨水花园": 10}, selected="雨水花园")
雨水花园_2 = Curve()

boundary_3 = BoundarySurfaces(Edges=汇水分区1)
boundary_4 = BoundarySurfaces(Edges=汇水分区2)
boundary_5 = BoundarySurfaces(Edges=汇水分区3)
boundary_6 = BoundarySurfaces(Edges=汇水分区4)
boundary_7 = BoundarySurfaces(Edges=汇水分区5)
brep_2 = Brep(boundary_3)
brep_3 = Brep(boundary_5)
brep_4 = Brep(boundary_6)
brep_5 = Brep(boundary_7)
brep_6 = Brep(boundary_4)
preview_2 = CustomPreview(Geometry=brep_2, Shader=ColourSwatch(SwatchColor=RGB(0, 0, 0)))
preview_3 = CustomPreview(Geometry=brep_6, Shader=ColourSwatch(SwatchColor=RGB(0, 0, 0)))
preview_4 = CustomPreview(Geometry=brep_3, Shader=ColourSwatch(SwatchColor=RGB(0, 0, 0)))
preview_5 = CustomPreview(Geometry=brep_4, Shader=ColourSwatch(SwatchColor=RGB(0, 0, 0)))
preview_6 = CustomPreview(Geometry=brep_5, Shader=ColourSwatch(SwatchColor=RGB(0, 0, 0)))

# ----
# 污染消减率ss
下凹绿地_3 = Panel("0.8")
雨水花园_3 = Panel("0.8")
透水铺装_2 = Panel("0.85")
生态停车位_2 = Panel("0.85")
植草沟_3 = Panel("0")
生物滞留设施_3 = Panel("0.8")

用地面积 = Panel(ma.Result)
boundary_8 = BoundarySurfaces(Edges=硬质屋面_2)
boundary_9 = BoundarySurfaces(Edges=绿化屋面_2)
boundary_10 = BoundarySurfaces(Edges=绿地)
boundary_11 = BoundarySurfaces(Edges=活动广场)
boundary_12 = BoundarySurfaces(Edges=水面_2)
boundary_13 = BoundarySurfaces(Edges=园路)
boundary_14 = BoundarySurfaces(Edges=道路_2)
boundary_15 = BoundarySurfaces(Edges=机动车停车位)
boundary_16 = BoundarySurfaces(Edges=非机动车停车位)
boundary_17 = BoundarySurfaces(Edges=硬质屋面_3)
boundary_18 = BoundarySurfaces(Edges=绿化屋面_3)
boundary_19 = BoundarySurfaces(Edges=绿地_2)
boundary_20 = BoundarySurfaces(Edges=活动广场_2)
boundary_21 = BoundarySurfaces(Edges=水面_3)
boundary_22 = BoundarySurfaces(Edges=园路_2)
boundary_23 = BoundarySurfaces(Edges=道路_3)
boundary_24 = BoundarySurfaces(Edges=机动车停车位_2)
boundary_25 = BoundarySurfaces(Edges=非机动车停车位_2)
boundary_26 = BoundarySurfaces(Edges=下凹绿地_2)
boundary_27 = BoundarySurfaces(Edges=植草沟_2)
boundary_28 = BoundarySurfaces(Edges=生物滞留设施_2)
boundary_29 = BoundarySurfaces(Edges=雨水花园_2)
brep_7 = Brep(boundary_8)
brep_8 = Brep(boundary_14)
brep_9 = Brep(boundary_15)
brep_10 = Brep(boundary_16)
brep_11 = Brep(boundary_13)
brep_12 = Brep(boundary_12)
brep_13 = Brep(boundary_10)
brep_14 = Brep(boundary_11)
brep_15 = Brep(boundary_9)
brep_16 = Brep(boundary_17)
brep_17 = Brep(boundary_23)
brep_18 = Brep(boundary_24)
brep_19 = Brep(boundary_25)
brep_20 = Brep(boundary_19)
brep_21 = Brep(boundary_22)
brep_22 = Brep(boundary_20)
brep_23 = Brep(boundary_21)
brep_24 = Brep(boundary_18)
brep_25 = Brep(boundary_26)
brep_26 = Brep(boundary_27)
brep_27 = Brep(boundary_28)
brep_28 = Brep(boundary_29)

# ----
# LID设施
# 下凹绿地
# 植草沟
# 雨水花园
# 生物滞留设施
深度m = Panel("0.15")
深度m_2 = Panel("0.15")
深度m_3 = Panel("0.15")
深度m_4 = Panel("0.3")
有效系数 = Panel("1")
有效系数_2 = Panel("0.8")
有效系数_3 = Panel("0.8")
有效系数_4 = Panel("1")

# ----
# 预览效果，检查模型
swatch = ColourSwatch(SwatchColor=RGBA(255, 0, 0, 86))
preview_7 = CustomPreview(Geometry=brep_16, Shader=ColourSwatch(SwatchColor=RGBA(255, 0, 0, 86)))
preview_8 = CustomPreview(Geometry=brep_24, Shader=ColourSwatch(SwatchColor=RGBA(255, 0, 0, 86)))
preview_9 = CustomPreview(Geometry=brep_20, Shader=ColourSwatch(SwatchColor=RGB(39, 117, 49)))
preview_10 = CustomPreview(Geometry=brep_22, Shader=ColourSwatch(SwatchColor=RGBA(15, 0, 28, 156)))
preview_11 = CustomPreview(Geometry=brep_23, Shader=ColourSwatch(SwatchColor=RGB(0, 34, 255)))
preview_12 = CustomPreview(Geometry=brep_21, Shader=ColourSwatch(SwatchColor=RGBA(0, 44, 176, 133)))
preview_13 = CustomPreview(Geometry=brep_17, Shader=ColourSwatch(SwatchColor=RGBA(0, 0, 0, 97)))
preview_14 = CustomPreview(Geometry=brep_18, Shader=ColourSwatch(SwatchColor=RGBA(255, 212, 0, 86)))
preview_15 = CustomPreview(Geometry=brep_19, Shader=ColourSwatch(SwatchColor=RGBA(255, 166, 0, 103)))
preview_16 = CustomPreview(Geometry=brep_25, Shader=ColourSwatch(SwatchColor=RGB(36, 0, 0)))
preview_17 = CustomPreview(Geometry=brep_26, Shader=ColourSwatch(SwatchColor=RGB(36, 0, 0)))
preview_18 = CustomPreview(Geometry=brep_27, Shader=ColourSwatch(SwatchColor=RGB(36, 0, 0)))
preview_19 = CustomPreview(Geometry=brep_28, Shader=ColourSwatch(SwatchColor=RGB(36, 0, 0)))
preview_20 = CustomPreview(Geometry=brep_7, Shader=swatch)
preview_21 = CustomPreview(Geometry=brep_15, Shader=ColourSwatch(SwatchColor=RGBA(119, 255, 0, 86)))
preview_22 = CustomPreview(Geometry=brep_13, Shader=ColourSwatch(SwatchColor=RGB(39, 117, 49)))
preview_23 = CustomPreview(Geometry=brep_14, Shader=ColourSwatch(SwatchColor=RGB(121, 0, 227)))
preview_24 = CustomPreview(Geometry=brep_12, Shader=ColourSwatch(SwatchColor=RGB(0, 34, 255)))
preview_25 = CustomPreview(Geometry=brep_11, Shader=ColourSwatch(SwatchColor=RGBA(0, 44, 176, 133)))
preview_26 = CustomPreview(Geometry=brep_8, Shader=ColourSwatch(SwatchColor=RGBA(0, 0, 0, 97)))
preview_27 = CustomPreview(Geometry=brep_9, Shader=ColourSwatch(SwatchColor=RGBA(255, 212, 0, 86)))
preview_28 = CustomPreview(Geometry=brep_10, Shader=ColourSwatch(SwatchColor=RGBA(255, 166, 0, 103)))

# ----
# 整个地块
# 总面积 [m2]
# 计算面积
# 减去园路面积
area_2 = Area(Geometry=brep_8)  # -> Area, Centroid
area_3 = Area(Geometry=brep_13)  # -> Area, Centroid
area_4 = Area(Geometry=brep_7)  # -> Area, Centroid
area_5 = Area(Geometry=brep_9)  # -> Area, Centroid
area_6 = Area(Geometry=brep_11)  # -> Area, Centroid
area_7 = Area(Geometry=brep_14)  # -> Area, Centroid
area_8 = Area(Geometry=brep_12)  # -> Area, Centroid
area_9 = Area(Geometry=brep_15)  # -> Area, Centroid
area_10 = Area(Geometry=brep_10)  # -> Area, Centroid
ma_2 = MassAddition(Input=area_2.Area)  # -> Result, PartialResults
ma_3 = MassAddition(Input=area_3.Area)  # -> Result, PartialResults
ma_4 = MassAddition(Input=area_4.Area)  # -> Result, PartialResults
ma_5 = MassAddition(Input=area_5.Area)  # -> Result, PartialResults
ma_6 = MassAddition(Input=area_6.Area)  # -> Result, PartialResults
ma_7 = MassAddition(Input=area_7.Area)  # -> Result, PartialResults
ma_8 = MassAddition(Input=area_8.Area)  # -> Result, PartialResults
ma_9 = MassAddition(Input=area_9.Area)  # -> Result, PartialResults
ma_10 = MassAddition(Input=area_10.Area)  # -> Result, PartialResults
硬质屋面_4 = Panel(ma_4.Result)
绿化屋面_4 = Panel(ma_9.Result)
道路_4 = Panel(ma_2.Result)
园路_3 = Panel(ma_6.Result)
addition = Addition(A=园路_3, B=0)
subtraction = Subtraction(A=ma_3.Result, B=addition)
绿地_3 = Panel(subtraction)
活动广场_3 = Panel(ma_7.Result)
水面_4 = Panel(ma_8.Result)
机动车停车位_3 = Panel(ma_5.Result)
非机动车停车位_3 = Panel(ma_10.Result)
merge_2 = Merge(
    Data1=硬质屋面_4,
    Data2=绿化屋面_4,
    Data3=道路_4,
    Data4=机动车停车位_3,
    Data5=非机动车停车位_3,
    Data6=绿地_3,
    Data7=园路_3,
    Data8=活动广场_3,
    Data9=水面_4)
ma_11 = MassAddition(Input=merge_2)  # -> Result, PartialResults
subtraction_2 = Subtraction(A=用地面积_m2, B=ma_11.Result)
其他硬质铺装 = Panel(subtraction_2)

# ----
# 整个地块
# 总面积 [m2]
# 减去园路、LID面积
area_11 = Area(Geometry=brep_24)  # -> Area, Centroid
area_12 = Area(Geometry=brep_25)  # -> Area, Centroid
area_13 = Area(Geometry=brep_17)  # -> Area, Centroid
area_14 = Area(Geometry=brep_20)  # -> Area, Centroid
area_15 = Area(Geometry=brep_16)  # -> Area, Centroid
area_16 = Area(Geometry=brep_18)  # -> Area, Centroid
area_17 = Area(Geometry=brep_21)  # -> Area, Centroid
area_18 = Area(Geometry=brep_22)  # -> Area, Centroid
area_19 = Area(Geometry=brep_23)  # -> Area, Centroid
area_20 = Area(Geometry=brep_26)  # -> Area, Centroid
area_21 = Area(Geometry=brep_27)  # -> Area, Centroid
area_22 = Area(Geometry=brep_19)  # -> Area, Centroid
area_23 = Area(Geometry=brep_28)  # -> Area, Centroid
ma_12 = MassAddition(Input=area_11.Area)  # -> Result, PartialResults
ma_13 = MassAddition(Input=area_12.Area)  # -> Result, PartialResults
ma_14 = MassAddition(Input=area_13.Area)  # -> Result, PartialResults
ma_15 = MassAddition(Input=area_14.Area)  # -> Result, PartialResults
ma_16 = MassAddition(Input=area_15.Area)  # -> Result, PartialResults
ma_17 = MassAddition(Input=area_16.Area)  # -> Result, PartialResults
ma_18 = MassAddition(Input=area_17.Area)  # -> Result, PartialResults
ma_19 = MassAddition(Input=area_18.Area)  # -> Result, PartialResults
ma_20 = MassAddition(Input=area_19.Area)  # -> Result, PartialResults
ma_21 = MassAddition(Input=area_20.Area)  # -> Result, PartialResults
ma_22 = MassAddition(Input=area_21.Area)  # -> Result, PartialResults
ma_23 = MassAddition(Input=area_22.Area)  # -> Result, PartialResults
ma_24 = MassAddition(Input=area_23.Area)  # -> Result, PartialResults
下凹绿地_4 = Panel(ma_13.Result)
绿化屋面_5 = Panel(ma_12.Result)
道路_5 = Panel(ma_14.Result)
园路_4 = Panel(ma_18.Result)
活动广场_4 = Panel(ma_19.Result)
水面_5 = Panel(ma_20.Result)
硬质屋面_5 = Panel(ma_16.Result)
机动车停车位_4 = Panel(ma_17.Result)
非机动车停车位_4 = Panel(ma_23.Result)
植草沟_4 = Panel(ma_21.Result)
雨水花园_4 = Panel(ma_24.Result)
生物滞留设施_4 = Panel(ma_22.Result)
lid_sum = Addition(A=下凹绿地_4, B=植草沟_4, C=雨水花园_4, D=生物滞留设施_4)
addition_2 = Addition(A=园路_4, B=lid_sum, C=0)
subtraction_3 = Subtraction(A=ma_15.Result, B=addition_2)
绿地_4 = Panel(subtraction_3)
merge_3 = Merge(
    Data1=硬质屋面_5,
    Data2=绿化屋面_5,
    Data3=道路_5,
    Data4=机动车停车位_4,
    Data5=非机动车停车位_4,
    Data6=绿地_4,
    Data7=园路_4,
    Data8=活动广场_4,
    Data9=水面_5,
    Data10=lid_sum)
ma_25 = MassAddition(Input=merge_3)  # -> Result, PartialResults
subtraction_4 = Subtraction(A=用地面积_m2, B=ma_25.Result)
其他硬质铺装_2 = Panel(subtraction_4)

# ----
# 面积*径流系数
# SUM(面积*径流系数)
# SUM(面积*径流系数)/总面积
list_23 = ValueList({"硬质屋面": 0, "绿化屋面": 1, "硬质铺装": 2, "透水铺装": 3, "生态停车位": 4, "道路": 5, "普通绿地": 6, "水面": 7, "下凹绿地": 8, "植草沟": 9, "雨水花园": 10, "生物滞留设施": 11}, selected="硬质铺装")
item = ListItem(List=merge, Index=list, Wrap=True)
item_2 = ListItem(List=merge, Index=list_2, Wrap=True)
item_3 = ListItem(List=merge, Index=list_3, Wrap=True)
item_4 = ListItem(List=merge, Index=list_4, Wrap=True)
item_5 = ListItem(List=merge, Index=list_8, Wrap=True)
item_6 = ListItem(List=merge, Index=list_6, Wrap=True)
item_7 = ListItem(List=merge, Index=list_7, Wrap=True)
item_8 = ListItem(List=merge, Index=list_9, Wrap=True)
item_9 = ListItem(List=merge, Index=list_5, Wrap=True)
item_10 = ListItem(List=merge, Index=list_23, Wrap=True)
eval = Evaluate(F="x*y", x=硬质屋面_4, y=item)
eval_2 = Evaluate(F="x*y", x=绿化屋面_4, y=item_2)
eval_3 = Evaluate(F="x*y", x=道路_4, y=item_3)
eval_4 = Evaluate(F="x*y", x=机动车停车位_3, y=item_4)
eval_5 = Evaluate(F="x*y", x=活动广场_3, y=item_5)
eval_6 = Evaluate(F="x*y", x=绿地_3, y=item_6)
eval_7 = Evaluate(F="x*y", x=园路_3, y=item_7)
eval_8 = Evaluate(F="x*y", x=水面_4, y=item_8)
eval_9 = Evaluate(F="x*y", x=非机动车停车位_3, y=item_9)
eval_10 = Evaluate(F="x*y", x=其他硬质铺装, y=item_10)
sum = Addition(A=eval, B=eval_2, C=eval_3, D=eval_4, E=eval_9, F=eval_6, G=eval_7, H=eval_5, I=eval_8, J=eval_10)
division = Division(A=sum, B=用地面积_m2)

# ----
# 整个地块
# 汇总
# 综合径流系数
# 雨水设计径流总量
综合径流系数 = Panel(division)
面积m2 = Panel(用地面积_m2)
eval_11 = Evaluate(F="10*x*y*z/10000", x=面积m2, y=综合径流系数, z=设计降雨量_mm)
雨水设计径流总量_m3 = Panel(eval_11)

addition_3 = Addition(A=道路_4, B=0)
addition_4 = Addition(A=绿地_3, B=0)
addition_5 = Addition(A=水面_4, B=0)

# ----
# 下垫面面积统计
# Gate输出口:
# 0:硬质屋面
# 1:绿化屋面
# 2:硬质铺装
# 3:透水铺装
# 4:生态停车位
# 统计各下垫面面积，输出至表格
# 硬质铺装时输出面积，其他情况输出0
# 透水铺装时输出面积，其他情况输出0
# 设计前未设计LID设施
# 生态停车位时输出面积，其他情况输出0
机动车 = StreamGate(Stream=机动车停车位_3, Gate=list_4)  # -> Target0, Target1, Target2, Target3, Target4
非机动车 = StreamGate(Stream=非机动车停车位_3, Gate=list_5)  # -> Target0, Target1, Target2, Target3, Target4
园路_5 = StreamGate(Stream=园路_3, Gate=list_7)  # -> Target0, Target1, Target2, Target3, Target4
活动广场_5 = StreamGate(Stream=活动广场_3, Gate=list_8)  # -> Target0, Target1, Target2, Target3, Target4
绿化屋面_6 = StreamGate(Stream=绿化屋面_4, Gate=list_2)  # -> Target0, Target1, Target2, Target3, Target4
merge_4 = Merge(Data1=机动车.Target3, Data2=非机动车.Target3, Data3=园路_5.Target3, Data4=活动广场_5.Target3)
merge_5 = Merge(Data1=机动车.Target2, Data2=非机动车.Target2, Data3=园路_5.Target2, Data4=活动广场_5.Target2)
merge_6 = Merge(Data1=机动车.Target4, Data2=非机动车.Target4, Data3=园路_5.Target4, Data4=活动广场_5.Target4)
addition_6 = Addition(A=硬质屋面_4, B=绿化屋面_6.Target0, C=0)
addition_7 = Addition(A=绿化屋面_6.Target1, B=0)
ma_26 = MassAddition(Input=merge_5)  # -> Result, PartialResults
ma_27 = MassAddition(Input=merge_4)  # -> Result, PartialResults
ma_28 = MassAddition(Input=merge_6)  # -> Result, PartialResults
硬质屋面_6 = Panel(addition_6)
绿化屋面_7 = Panel(addition_7)
addition_8 = Addition(A=ma_27.Result, B=0)
道路_6 = Panel(addition_3)
addition_9 = Addition(A=ma_26.Result, B=其他硬质铺装)
普通绿地_2 = Panel(addition_4)
addition_10 = Addition(A=ma_28.Result, B=0)
水面_6 = Panel(addition_5)
硬质铺装_2 = Panel(addition_9)
透水铺装_3 = Panel(addition_8)
生态停车位_3 = Panel(addition_10)
无lid设施 = Panel("0")
merge_7 = Merge(
    Data1=flatten(硬质屋面_6),
    Data2=flatten(绿化屋面_7),
    Data3=flatten(道路_6),
    Data4=flatten(普通绿地_2),
    Data5=flatten(硬质铺装_2),
    Data6=flatten(透水铺装_3),
    Data7=flatten(生态停车位_3),
    Data8=flatten(水面_6),
    Data9=flatten(无lid设施),
    Data10=flatten(无lid设施),
    Data11=flatten(无lid设施),
    Data12=flatten(无lid设施),
    Data13=flatten(面积m2))

# ----
# 第一汇水分区
# 轮廓线与汇水
# 分区轮廓线交集
# 汇水分区面积
# 用地红线与汇水
# 分区轮廓线交集
rint = RegionIntersection(CurvesA=硬质屋面_2, CurvesB=汇水分区1)
rint_2 = RegionIntersection(CurvesA=绿化屋面_2, CurvesB=汇水分区1)
rint_3 = RegionIntersection(CurvesA=道路_2, CurvesB=汇水分区1)
rint_4 = RegionIntersection(CurvesA=机动车停车位, CurvesB=汇水分区1)
rint_5 = RegionIntersection(CurvesA=非机动车停车位, CurvesB=汇水分区1)
rint_6 = RegionIntersection(CurvesA=绿地, CurvesB=汇水分区1)
rint_7 = RegionIntersection(CurvesA=园路, CurvesB=汇水分区1)
rint_8 = RegionIntersection(CurvesA=活动广场, CurvesB=汇水分区1)
rint_9 = RegionIntersection(CurvesA=水面_2, CurvesB=汇水分区1)
rint_10 = RegionIntersection(CurvesA=用地红线, CurvesB=汇水分区1)
boundary_30 = BoundarySurfaces(Edges=rint)
boundary_31 = BoundarySurfaces(Edges=rint_2)
boundary_32 = BoundarySurfaces(Edges=rint_3)
boundary_33 = BoundarySurfaces(Edges=rint_4)
boundary_34 = BoundarySurfaces(Edges=rint_5)
boundary_35 = BoundarySurfaces(Edges=rint_6)
boundary_36 = BoundarySurfaces(Edges=rint_7)
boundary_37 = BoundarySurfaces(Edges=rint_8)
boundary_38 = BoundarySurfaces(Edges=rint_9)
boundary_39 = BoundarySurfaces(Edges=rint_10)
brep_29 = Brep(boundary_30)
brep_30 = Brep(boundary_31)
brep_31 = Brep(boundary_35)
brep_32 = Brep(boundary_36)
brep_33 = Brep(boundary_32)
brep_34 = Brep(boundary_33)
brep_35 = Brep(boundary_34)
brep_36 = Brep(boundary_37)
brep_37 = Brep(boundary_38)
brep_38 = Brep(boundary_39)
area_24 = Area(Geometry=brep_29)  # -> Area, Centroid
area_25 = Area(Geometry=brep_30)  # -> Area, Centroid
area_26 = Area(Geometry=brep_32)  # -> Area, Centroid
area_27 = Area(Geometry=brep_35)  # -> Area, Centroid
area_28 = Area(Geometry=brep_31)  # -> Area, Centroid
area_29 = Area(Geometry=brep_34)  # -> Area, Centroid
area_30 = Area(Geometry=brep_36)  # -> Area, Centroid
area_31 = Area(Geometry=brep_33)  # -> Area, Centroid
area_32 = Area(Geometry=brep_37)  # -> Area, Centroid
area_33 = Area(Geometry=brep_38)  # -> Area, Centroid
ma_29 = MassAddition(Input=area_24.Area)  # -> Result, PartialResults
ma_30 = MassAddition(Input=area_25.Area)  # -> Result, PartialResults
ma_31 = MassAddition(Input=area_26.Area)  # -> Result, PartialResults
ma_32 = MassAddition(Input=area_27.Area)  # -> Result, PartialResults
ma_33 = MassAddition(Input=area_28.Area)  # -> Result, PartialResults
ma_34 = MassAddition(Input=area_29.Area)  # -> Result, PartialResults
ma_35 = MassAddition(Input=area_30.Area)  # -> Result, PartialResults
ma_36 = MassAddition(Input=area_31.Area)  # -> Result, PartialResults
ma_37 = MassAddition(Input=area_32.Area)  # -> Result, PartialResults
硬质屋面_7 = Panel(ma_29.Result)
绿化屋面_8 = Panel(ma_30.Result)
道路_7 = Panel(ma_36.Result)
机动车停车位_5 = Panel(ma_34.Result)
非机动车停车位_5 = Panel(ma_32.Result)
园路_6 = Panel(ma_31.Result)
addition_11 = Addition(A=园路_6, B=0)
subtraction_5 = Subtraction(A=ma_33.Result, B=addition_11)
绿地_5 = Panel(subtraction_5)
活动广场_6 = Panel(ma_35.Result)
水面_7 = Panel(ma_37.Result)
merge_8 = Merge(
    Data1=硬质屋面_7,
    Data2=绿化屋面_8,
    Data3=道路_7,
    Data4=机动车停车位_5,
    Data5=非机动车停车位_5,
    Data6=绿地_5,
    Data7=园路_6,
    Data8=活动广场_6,
    Data9=水面_7)
ma_38 = MassAddition(Input=merge_8)  # -> Result, PartialResults
subtraction_6 = Subtraction(A=area_33.Area, B=ma_38.Result)
其他硬质铺装_3 = Panel(subtraction_6)

# ----
# 第一汇水分区
rint_11 = RegionIntersection(CurvesA=下凹绿地_2, CurvesB=汇水分区1)
rint_12 = RegionIntersection(CurvesA=植草沟_2, CurvesB=汇水分区1)
rint_13 = RegionIntersection(CurvesA=硬质屋面_3, CurvesB=汇水分区1)
rint_14 = RegionIntersection(CurvesA=生物滞留设施_2, CurvesB=汇水分区1)
rint_15 = RegionIntersection(CurvesA=雨水花园_2, CurvesB=汇水分区1)
rint_16 = RegionIntersection(CurvesA=绿化屋面_3, CurvesB=汇水分区1)
rint_17 = RegionIntersection(CurvesA=道路_3, CurvesB=汇水分区1)
rint_18 = RegionIntersection(CurvesA=机动车停车位_2, CurvesB=汇水分区1)
rint_19 = RegionIntersection(CurvesA=非机动车停车位_2, CurvesB=汇水分区1)
rint_20 = RegionIntersection(CurvesA=绿地_2, CurvesB=汇水分区1)
rint_21 = RegionIntersection(CurvesA=园路_2, CurvesB=汇水分区1)
rint_22 = RegionIntersection(CurvesA=活动广场_2, CurvesB=汇水分区1)
rint_23 = RegionIntersection(CurvesA=水面_3, CurvesB=汇水分区1)
rint_24 = RegionIntersection(CurvesA=用地红线, CurvesB=汇水分区1)
boundary_40 = BoundarySurfaces(Edges=rint_11)
boundary_41 = BoundarySurfaces(Edges=rint_12)
boundary_42 = BoundarySurfaces(Edges=rint_13)
boundary_43 = BoundarySurfaces(Edges=rint_14)
boundary_44 = BoundarySurfaces(Edges=rint_15)
boundary_45 = BoundarySurfaces(Edges=rint_16)
boundary_46 = BoundarySurfaces(Edges=rint_17)
boundary_47 = BoundarySurfaces(Edges=rint_18)
boundary_48 = BoundarySurfaces(Edges=rint_19)
boundary_49 = BoundarySurfaces(Edges=rint_20)
boundary_50 = BoundarySurfaces(Edges=rint_21)
boundary_51 = BoundarySurfaces(Edges=rint_22)
boundary_52 = BoundarySurfaces(Edges=rint_23)
boundary_53 = BoundarySurfaces(Edges=rint_24)
brep_39 = Brep(boundary_40)
brep_40 = Brep(boundary_41)
brep_41 = Brep(boundary_42)
brep_42 = Brep(boundary_43)
brep_43 = Brep(boundary_44)
brep_44 = Brep(boundary_45)
brep_45 = Brep(boundary_46)
brep_46 = Brep(boundary_47)
brep_47 = Brep(boundary_48)
brep_48 = Brep(boundary_49)
brep_49 = Brep(boundary_50)
brep_50 = Brep(boundary_51)
brep_51 = Brep(boundary_52)
brep_52 = Brep(boundary_53)
area_34 = Area(Geometry=brep_39)  # -> Area, Centroid
area_35 = Area(Geometry=brep_40)  # -> Area, Centroid
area_36 = Area(Geometry=brep_42)  # -> Area, Centroid
area_37 = Area(Geometry=brep_43)  # -> Area, Centroid
area_38 = Area(Geometry=brep_41)  # -> Area, Centroid
area_39 = Area(Geometry=brep_49)  # -> Area, Centroid
area_40 = Area(Geometry=brep_47)  # -> Area, Centroid
area_41 = Area(Geometry=brep_48)  # -> Area, Centroid
area_42 = Area(Geometry=brep_46)  # -> Area, Centroid
area_43 = Area(Geometry=brep_50)  # -> Area, Centroid
area_44 = Area(Geometry=brep_44)  # -> Area, Centroid
area_45 = Area(Geometry=brep_45)  # -> Area, Centroid
area_46 = Area(Geometry=brep_51)  # -> Area, Centroid
area_47 = Area(Geometry=brep_52)  # -> Area, Centroid
ma_39 = MassAddition(Input=area_34.Area)  # -> Result, PartialResults
ma_40 = MassAddition(Input=area_35.Area)  # -> Result, PartialResults
ma_41 = MassAddition(Input=area_38.Area)  # -> Result, PartialResults
ma_42 = MassAddition(Input=area_36.Area)  # -> Result, PartialResults
ma_43 = MassAddition(Input=area_37.Area)  # -> Result, PartialResults
ma_44 = MassAddition(Input=area_44.Area)  # -> Result, PartialResults
ma_45 = MassAddition(Input=area_39.Area)  # -> Result, PartialResults
ma_46 = MassAddition(Input=area_40.Area)  # -> Result, PartialResults
ma_47 = MassAddition(Input=area_41.Area)  # -> Result, PartialResults
ma_48 = MassAddition(Input=area_42.Area)  # -> Result, PartialResults
ma_49 = MassAddition(Input=area_43.Area)  # -> Result, PartialResults
ma_50 = MassAddition(Input=area_45.Area)  # -> Result, PartialResults
ma_51 = MassAddition(Input=area_46.Area)  # -> Result, PartialResults
下凹绿地_5 = Panel(ma_39.Result)
植草沟_5 = Panel(ma_40.Result)
生物滞留设施_5 = Panel(ma_42.Result)
雨水花园_5 = Panel(ma_43.Result)
硬质屋面_8 = Panel(ma_41.Result)
道路_8 = Panel(ma_50.Result)
非机动车停车位_6 = Panel(ma_46.Result)
园路_7 = Panel(ma_45.Result)
水面_8 = Panel(ma_51.Result)
绿化屋面_9 = Panel(ma_44.Result)
机动车停车位_6 = Panel(ma_48.Result)
活动广场_7 = Panel(ma_49.Result)
lid_sum_2 = Addition(A=下凹绿地_5, B=植草沟_5, C=雨水花园_5, D=生物滞留设施_5)
addition_12 = Addition(A=园路_7, B=lid_sum_2, C=0)
subtraction_7 = Subtraction(A=ma_47.Result, B=addition_12)
绿地_6 = Panel(subtraction_7)
merge_9 = Merge(
    Data1=硬质屋面_8,
    Data2=绿化屋面_9,
    Data3=道路_8,
    Data4=机动车停车位_6,
    Data5=非机动车停车位_6,
    Data6=绿地_6,
    Data7=园路_7,
    Data8=活动广场_7,
    Data9=水面_8,
    Data10=lid_sum_2)
ma_52 = MassAddition(Input=merge_9)  # -> Result, PartialResults
subtraction_8 = Subtraction(A=area_47.Area, B=ma_52.Result)
其他硬质铺装_4 = Panel(subtraction_8)

list_24 = ValueList({"硬质屋面": 0, "绿化屋面": 1, "硬质铺装": 2, "透水铺装": 3, "生态停车位": 4, "道路": 5, "普通绿地": 6, "水面": 7, "下凹绿地": 8, "植草沟": 9, "雨水花园": 10, "生物滞留设施": 11}, selected="硬质铺装")
item_11 = ListItem(List=merge, Index=list, Wrap=True)
item_12 = ListItem(List=merge, Index=list_2, Wrap=True)
item_13 = ListItem(List=merge, Index=list_3, Wrap=True)
item_14 = ListItem(List=merge, Index=list_4, Wrap=True)
item_15 = ListItem(List=merge, Index=list_8, Wrap=True)
item_16 = ListItem(List=merge, Index=list_6, Wrap=True)
item_17 = ListItem(List=merge, Index=list_7, Wrap=True)
item_18 = ListItem(List=merge, Index=list_9, Wrap=True)
item_19 = ListItem(List=merge, Index=list_5, Wrap=True)
item_20 = ListItem(List=merge, Index=list_24, Wrap=True)
eval_12 = Evaluate(F="x*y", x=硬质屋面_7, y=item_11)
eval_13 = Evaluate(F="x*y", x=绿化屋面_8, y=item_12)
eval_14 = Evaluate(F="x*y", x=道路_7, y=item_13)
eval_15 = Evaluate(F="x*y", x=机动车停车位_5, y=item_14)
eval_16 = Evaluate(F="x*y", x=活动广场_6, y=item_15)
eval_17 = Evaluate(F="x*y", x=绿地_5, y=item_16)
eval_18 = Evaluate(F="x*y", x=园路_6, y=item_17)
eval_19 = Evaluate(F="x*y", x=水面_7, y=item_18)
eval_20 = Evaluate(F="x*y", x=非机动车停车位_5, y=item_19)
eval_21 = Evaluate(F="x*y", x=其他硬质铺装_3, y=item_20)
sum_2 = Addition(A=eval_12, B=eval_13, C=eval_14, D=eval_15, E=eval_20, F=eval_17, G=eval_18, H=eval_16, I=eval_19, J=eval_21)
division_2 = Division(A=sum_2, B=area_33.Area)

# ----
# 第一汇水分区
# 汇总
# 综合径流系数
# 雨水设计径流总量
面积m2_2 = Panel(area_33.Area)
综合径流系数_2 = Panel(division_2)
eval_22 = Evaluate(F="10*x*y*z/10000", x=面积m2_2, y=综合径流系数_2, z=设计降雨量_mm)
雨水设计径流总量_m3_2 = Panel(eval_22)

# ----
# 下垫面面积统计
机动车_2 = StreamGate(Stream=机动车停车位_5, Gate=list_4)  # -> Target0, Target1, Target2, Target3, Target4
非机动车_2 = StreamGate(Stream=非机动车停车位_5, Gate=list_5)  # -> Target0, Target1, Target2, Target3, Target4
园路_8 = StreamGate(Stream=园路_6, Gate=list_7)  # -> Target0, Target1, Target2, Target3, Target4
广场 = StreamGate(Stream=活动广场_6, Gate=list_8)  # -> Target0, Target1, Target2, Target3, Target4
绿化屋面_10 = StreamGate(Stream=绿化屋面_8, Gate=list_2)  # -> Target0, Target1, Target2, Target3, Target4
merge_10 = Merge(Data1=机动车_2.Target3, Data2=非机动车_2.Target3, Data3=园路_8.Target3, Data4=广场.Target3)
merge_11 = Merge(Data1=机动车_2.Target2, Data2=非机动车_2.Target2, Data3=园路_8.Target2, Data4=广场.Target2)
merge_12 = Merge(Data1=机动车_2.Target4, Data2=非机动车_2.Target4, Data3=园路_8.Target4, Data4=广场.Target4)
addition_13 = Addition(A=硬质屋面_7, B=绿化屋面_10.Target0, C=0)
addition_14 = Addition(A=绿化屋面_10.Target1, B=0)
addition_15 = Addition(A=道路_7, B=0)
addition_16 = Addition(A=绿地_5, B=0)
ma_53 = MassAddition(Input=merge_11)  # -> Result, PartialResults
ma_54 = MassAddition(Input=merge_10)  # -> Result, PartialResults
addition_17 = Addition(A=水面_7, B=0)
ma_55 = MassAddition(Input=merge_12)  # -> Result, PartialResults
addition_18 = Addition(A=ma_54.Result, B=0)
addition_19 = Addition(A=ma_53.Result, B=其他硬质铺装_3)
addition_20 = Addition(A=ma_55.Result, B=0)
水面_9 = Panel(addition_17)
硬质屋面_9 = Panel(addition_13)
绿化屋面_11 = Panel(addition_14)
道路_9 = Panel(addition_15)
硬质铺装_3 = Panel(addition_19)
透水铺装_4 = Panel(addition_18)
普通绿地_3 = Panel(addition_16)
生态停车位_4 = Panel(addition_20)
无lid设施_2 = Panel("0")
merge_13 = Merge(
    Data1=flatten(硬质屋面_9),
    Data2=flatten(绿化屋面_11),
    Data3=flatten(道路_9),
    Data4=flatten(普通绿地_3),
    Data5=flatten(硬质铺装_3),
    Data6=flatten(透水铺装_4),
    Data7=flatten(生态停车位_4),
    Data8=flatten(水面_9),
    Data9=flatten(无lid设施_2),
    Data10=flatten(无lid设施_2),
    Data11=flatten(无lid设施_2),
    Data12=flatten(无lid设施_2),
    Data13=flatten(面积m2_2))

rint_25 = RegionIntersection(CurvesA=绿化屋面_3, CurvesB=汇水分区2)
rint_26 = RegionIntersection(CurvesA=硬质屋面_3, CurvesB=汇水分区2)
rint_27 = RegionIntersection(CurvesA=道路_3, CurvesB=汇水分区2)
rint_28 = RegionIntersection(CurvesA=机动车停车位_2, CurvesB=汇水分区2)
rint_29 = RegionIntersection(CurvesA=非机动车停车位_2, CurvesB=汇水分区2)
rint_30 = RegionIntersection(CurvesA=绿地_2, CurvesB=汇水分区2)
rint_31 = RegionIntersection(CurvesA=园路_2, CurvesB=汇水分区2)
rint_32 = RegionIntersection(CurvesA=活动广场_2, CurvesB=汇水分区2)
rint_33 = RegionIntersection(CurvesA=水面_3, CurvesB=汇水分区2)
rint_34 = RegionIntersection(CurvesA=用地红线, CurvesB=汇水分区2)
rint_35 = RegionIntersection(CurvesA=下凹绿地_2, CurvesB=汇水分区2)
rint_36 = RegionIntersection(CurvesA=植草沟_2, CurvesB=汇水分区2)
rint_37 = RegionIntersection(CurvesA=生物滞留设施_2, CurvesB=汇水分区2)
rint_38 = RegionIntersection(CurvesA=雨水花园_2, CurvesB=汇水分区2)
boundary_54 = BoundarySurfaces(Edges=rint_25)
boundary_55 = BoundarySurfaces(Edges=rint_26)
boundary_56 = BoundarySurfaces(Edges=rint_27)
boundary_57 = BoundarySurfaces(Edges=rint_28)
boundary_58 = BoundarySurfaces(Edges=rint_29)
boundary_59 = BoundarySurfaces(Edges=rint_30)
boundary_60 = BoundarySurfaces(Edges=rint_31)
boundary_61 = BoundarySurfaces(Edges=rint_32)
boundary_62 = BoundarySurfaces(Edges=rint_33)
boundary_63 = BoundarySurfaces(Edges=rint_34)
boundary_64 = BoundarySurfaces(Edges=rint_35)
boundary_65 = BoundarySurfaces(Edges=rint_36)
boundary_66 = BoundarySurfaces(Edges=rint_37)
boundary_67 = BoundarySurfaces(Edges=rint_38)
brep_53 = Brep(boundary_54)
brep_54 = Brep(boundary_59)
brep_55 = Brep(boundary_55)
brep_56 = Brep(boundary_56)
brep_57 = Brep(boundary_57)
brep_58 = Brep(boundary_58)
brep_59 = Brep(boundary_60)
brep_60 = Brep(boundary_61)
brep_61 = Brep(boundary_62)
brep_62 = Brep(boundary_63)
brep_63 = Brep(boundary_64)
brep_64 = Brep(boundary_65)
brep_65 = Brep(boundary_66)
brep_66 = Brep(boundary_67)
area_48 = Area(Geometry=brep_59)  # -> Area, Centroid
area_49 = Area(Geometry=brep_58)  # -> Area, Centroid
area_50 = Area(Geometry=brep_54)  # -> Area, Centroid
area_51 = Area(Geometry=brep_53)  # -> Area, Centroid
area_52 = Area(Geometry=brep_57)  # -> Area, Centroid
area_53 = Area(Geometry=brep_60)  # -> Area, Centroid
area_54 = Area(Geometry=brep_56)  # -> Area, Centroid
area_55 = Area(Geometry=brep_61)  # -> Area, Centroid
area_56 = Area(Geometry=brep_55)  # -> Area, Centroid
area_57 = Area(Geometry=brep_62)  # -> Area, Centroid
area_58 = Area(Geometry=brep_63)  # -> Area, Centroid
area_59 = Area(Geometry=brep_64)  # -> Area, Centroid
area_60 = Area(Geometry=brep_65)  # -> Area, Centroid
area_61 = Area(Geometry=brep_66)  # -> Area, Centroid
ma_56 = MassAddition(Input=area_48.Area)  # -> Result, PartialResults
ma_57 = MassAddition(Input=area_49.Area)  # -> Result, PartialResults
ma_58 = MassAddition(Input=area_50.Area)  # -> Result, PartialResults
ma_59 = MassAddition(Input=area_51.Area)  # -> Result, PartialResults
ma_60 = MassAddition(Input=area_52.Area)  # -> Result, PartialResults
ma_61 = MassAddition(Input=area_53.Area)  # -> Result, PartialResults
ma_62 = MassAddition(Input=area_54.Area)  # -> Result, PartialResults
ma_63 = MassAddition(Input=area_55.Area)  # -> Result, PartialResults
ma_64 = MassAddition(Input=area_56.Area)  # -> Result, PartialResults
ma_65 = MassAddition(Input=area_58.Area)  # -> Result, PartialResults
ma_66 = MassAddition(Input=area_59.Area)  # -> Result, PartialResults
ma_67 = MassAddition(Input=area_60.Area)  # -> Result, PartialResults
ma_68 = MassAddition(Input=area_61.Area)  # -> Result, PartialResults
园路_9 = Panel(ma_56.Result)
非机动车停车位_7 = Panel(ma_57.Result)
机动车停车位_7 = Panel(ma_60.Result)
活动广场_8 = Panel(ma_61.Result)
水面_10 = Panel(ma_63.Result)
硬质屋面_10 = Panel(ma_64.Result)
绿化屋面_12 = Panel(ma_59.Result)
道路_10 = Panel(ma_62.Result)
下凹绿地_6 = Panel(ma_65.Result)
植草沟_6 = Panel(ma_66.Result)
生物滞留设施_6 = Panel(ma_67.Result)
雨水花园_6 = Panel(ma_68.Result)
lid_sum_3 = Addition(A=下凹绿地_6, B=植草沟_6, C=雨水花园_6, D=生物滞留设施_6)
addition_21 = Addition(A=园路_9, B=lid_sum_3, C=0)
subtraction_9 = Subtraction(A=ma_58.Result, B=addition_21)
绿地_7 = Panel(subtraction_9)
merge_14 = Merge(
    Data1=硬质屋面_10,
    Data2=绿化屋面_12,
    Data3=道路_10,
    Data4=机动车停车位_7,
    Data5=非机动车停车位_7,
    Data6=绿地_7,
    Data7=园路_9,
    Data8=活动广场_8,
    Data9=水面_10,
    Data10=lid_sum_3)
ma_69 = MassAddition(Input=merge_14)  # -> Result, PartialResults
subtraction_10 = Subtraction(A=area_57.Area, B=ma_69.Result)
其他硬质铺装_5 = Panel(subtraction_10)

# ----
# 第二汇水分区
rint_39 = RegionIntersection(CurvesA=硬质屋面_2, CurvesB=汇水分区2)
rint_40 = RegionIntersection(CurvesA=道路_2, CurvesB=汇水分区2)
rint_41 = RegionIntersection(CurvesA=机动车停车位, CurvesB=汇水分区2)
rint_42 = RegionIntersection(CurvesA=非机动车停车位, CurvesB=汇水分区2)
rint_43 = RegionIntersection(CurvesA=绿地, CurvesB=汇水分区2)
rint_44 = RegionIntersection(CurvesA=园路, CurvesB=汇水分区2)
rint_45 = RegionIntersection(CurvesA=活动广场, CurvesB=汇水分区2)
rint_46 = RegionIntersection(CurvesA=水面_2, CurvesB=汇水分区2)
rint_47 = RegionIntersection(CurvesA=绿化屋面_2, CurvesB=汇水分区2)
rint_48 = RegionIntersection(CurvesA=用地红线, CurvesB=汇水分区2)
boundary_68 = BoundarySurfaces(Edges=rint_39)
boundary_69 = BoundarySurfaces(Edges=rint_40)
boundary_70 = BoundarySurfaces(Edges=rint_41)
boundary_71 = BoundarySurfaces(Edges=rint_42)
boundary_72 = BoundarySurfaces(Edges=rint_43)
boundary_73 = BoundarySurfaces(Edges=rint_44)
boundary_74 = BoundarySurfaces(Edges=rint_45)
boundary_75 = BoundarySurfaces(Edges=rint_46)
boundary_76 = BoundarySurfaces(Edges=rint_47)
boundary_77 = BoundarySurfaces(Edges=rint_48)
brep_67 = Brep(boundary_69)
brep_68 = Brep(boundary_70)
brep_69 = Brep(boundary_71)
brep_70 = Brep(boundary_72)
brep_71 = Brep(boundary_73)
brep_72 = Brep(boundary_74)
brep_73 = Brep(boundary_75)
brep_74 = Brep(boundary_68)
brep_75 = Brep(boundary_77)
brep_76 = Brep(boundary_76)
area_62 = Area(Geometry=brep_71)  # -> Area, Centroid
area_63 = Area(Geometry=brep_69)  # -> Area, Centroid
area_64 = Area(Geometry=brep_70)  # -> Area, Centroid
area_65 = Area(Geometry=brep_68)  # -> Area, Centroid
area_66 = Area(Geometry=brep_72)  # -> Area, Centroid
area_67 = Area(Geometry=brep_67)  # -> Area, Centroid
area_68 = Area(Geometry=brep_73)  # -> Area, Centroid
area_69 = Area(Geometry=brep_74)  # -> Area, Centroid
area_70 = Area(Geometry=brep_75)  # -> Area, Centroid
area_71 = Area(Geometry=brep_76)  # -> Area, Centroid
ma_70 = MassAddition(Input=area_62.Area)  # -> Result, PartialResults
ma_71 = MassAddition(Input=area_63.Area)  # -> Result, PartialResults
ma_72 = MassAddition(Input=area_64.Area)  # -> Result, PartialResults
ma_73 = MassAddition(Input=area_65.Area)  # -> Result, PartialResults
ma_74 = MassAddition(Input=area_66.Area)  # -> Result, PartialResults
ma_75 = MassAddition(Input=area_67.Area)  # -> Result, PartialResults
ma_76 = MassAddition(Input=area_68.Area)  # -> Result, PartialResults
ma_77 = MassAddition(Input=area_69.Area)  # -> Result, PartialResults
ma_78 = MassAddition(Input=area_71.Area)  # -> Result, PartialResults
园路_10 = Panel(ma_70.Result)
addition_22 = Addition(A=园路_10, B=0)
subtraction_11 = Subtraction(A=ma_72.Result, B=addition_22)
非机动车停车位_8 = Panel(ma_71.Result)
绿地_8 = Panel(subtraction_11)
机动车停车位_8 = Panel(ma_73.Result)
活动广场_9 = Panel(ma_74.Result)
绿化屋面_13 = Panel(ma_78.Result)
道路_11 = Panel(ma_75.Result)
水面_11 = Panel(ma_76.Result)
硬质屋面_11 = Panel(ma_77.Result)
merge_15 = Merge(
    Data1=硬质屋面_11,
    Data2=绿化屋面_13,
    Data3=道路_11,
    Data4=机动车停车位_8,
    Data5=非机动车停车位_8,
    Data6=绿地_8,
    Data7=园路_10,
    Data8=活动广场_9,
    Data9=水面_11)
ma_79 = MassAddition(Input=merge_15)  # -> Result, PartialResults
subtraction_12 = Subtraction(A=area_70.Area, B=ma_79.Result)
其他硬质铺装_6 = Panel(subtraction_12)

list_25 = ValueList({"硬质屋面": 0, "绿化屋面": 1, "硬质铺装": 2, "透水铺装": 3, "生态停车位": 4, "道路": 5, "普通绿地": 6, "水面": 7, "下凹绿地": 8, "植草沟": 9, "雨水花园": 10, "生物滞留设施": 11}, selected="硬质铺装")
item_21 = ListItem(List=merge, Index=list, Wrap=True)
item_22 = ListItem(List=merge, Index=list_2, Wrap=True)
item_23 = ListItem(List=merge, Index=list_3, Wrap=True)
item_24 = ListItem(List=merge, Index=list_4, Wrap=True)
item_25 = ListItem(List=merge, Index=list_8, Wrap=True)
item_26 = ListItem(List=merge, Index=list_6, Wrap=True)
item_27 = ListItem(List=merge, Index=list_7, Wrap=True)
item_28 = ListItem(List=merge, Index=list_9, Wrap=True)
item_29 = ListItem(List=merge, Index=list_5, Wrap=True)
item_30 = ListItem(List=merge, Index=list_25, Wrap=True)
eval_23 = Evaluate(F="x*y", x=硬质屋面_11, y=item_21)
eval_24 = Evaluate(F="x*y", x=绿化屋面_13, y=item_22)
eval_25 = Evaluate(F="x*y", x=道路_11, y=item_23)
eval_26 = Evaluate(F="x*y", x=机动车停车位_8, y=item_24)
eval_27 = Evaluate(F="x*y", x=活动广场_9, y=item_25)
eval_28 = Evaluate(F="x*y", x=绿地_8, y=item_26)
eval_29 = Evaluate(F="x*y", x=园路_10, y=item_27)
eval_30 = Evaluate(F="x*y", x=水面_11, y=item_28)
eval_31 = Evaluate(F="x*y", x=非机动车停车位_8, y=item_29)
eval_32 = Evaluate(F="x*y", x=其他硬质铺装_6, y=item_30)
sum_3 = Addition(A=eval_23, B=eval_24, C=eval_25, D=eval_26, E=eval_31, F=eval_28, G=eval_29, H=eval_27, I=eval_30, J=eval_32)
division_3 = Division(A=sum_3, B=area_70.Area)

# ----
# 第二汇水分区
# 汇总
# 综合径流系数
# 雨水设计径流总量
综合径流系数_3 = Panel(division_3)
面积m2_3 = Panel(area_70.Area)
eval_33 = Evaluate(F="10*x*y*z/10000", x=面积m2_3, y=综合径流系数_3, z=设计降雨量_mm)
雨水设计径流总量_m3_3 = Panel(eval_33)

# ----
# 下垫面面积统计
绿化屋面_14 = StreamGate(Stream=绿化屋面_13, Gate=list_2)  # -> Target0, Target1, Target2, Target3, Target4
机动车_3 = StreamGate(Stream=机动车停车位_8, Gate=list_4)  # -> Target0, Target1, Target2, Target3, Target4
非机动车_3 = StreamGate(Stream=非机动车停车位_8, Gate=list_5)  # -> Target0, Target1, Target2, Target3, Target4
园路_11 = StreamGate(Stream=园路_10, Gate=list_7)  # -> Target0, Target1, Target2, Target3, Target4
广场_2 = StreamGate(Stream=活动广场_9, Gate=list_8)  # -> Target0, Target1, Target2, Target3, Target4
merge_16 = Merge(Data1=机动车_3.Target3, Data2=非机动车_3.Target3, Data3=园路_11.Target3, Data4=广场_2.Target3)
merge_17 = Merge(Data1=机动车_3.Target2, Data2=非机动车_3.Target2, Data3=园路_11.Target2, Data4=广场_2.Target2)
merge_18 = Merge(Data1=机动车_3.Target4, Data2=非机动车_3.Target4, Data3=园路_11.Target4, Data4=广场_2.Target4)
addition_23 = Addition(A=硬质屋面_11, B=绿化屋面_14.Target0, C=0)
addition_24 = Addition(A=绿化屋面_14.Target1, B=0)
addition_25 = Addition(A=道路_11, B=0)
addition_26 = Addition(A=绿地_8, B=0)
ma_80 = MassAddition(Input=merge_17)  # -> Result, PartialResults
ma_81 = MassAddition(Input=merge_16)  # -> Result, PartialResults
ma_82 = MassAddition(Input=merge_18)  # -> Result, PartialResults
addition_27 = Addition(A=水面_11, B=0)
硬质屋面_12 = Panel(addition_23)
addition_28 = Addition(A=ma_81.Result, B=0)
绿化屋面_15 = Panel(addition_24)
addition_29 = Addition(A=ma_80.Result, B=其他硬质铺装_6)
addition_30 = Addition(A=ma_82.Result, B=0)
道路_12 = Panel(addition_25)
普通绿地_4 = Panel(addition_26)
水面_12 = Panel(addition_27)
透水铺装_5 = Panel(addition_28)
硬质铺装_4 = Panel(addition_29)
生态停车位_5 = Panel(addition_30)
无lid设施_3 = Panel("0")
merge_19 = Merge(
    Data1=flatten(硬质屋面_12),
    Data2=flatten(绿化屋面_15),
    Data3=flatten(道路_12),
    Data4=flatten(普通绿地_4),
    Data5=flatten(硬质铺装_4),
    Data6=flatten(透水铺装_5),
    Data7=flatten(生态停车位_5),
    Data8=flatten(水面_12),
    Data9=flatten(无lid设施_3),
    Data10=flatten(无lid设施_3),
    Data11=flatten(无lid设施_3),
    Data12=flatten(无lid设施_3),
    Data13=flatten(面积m2_3))

# ----
# 第三汇水分区
rint_49 = RegionIntersection(CurvesA=硬质屋面_3, CurvesB=汇水分区3)
rint_50 = RegionIntersection(CurvesA=绿化屋面_3, CurvesB=汇水分区3)
rint_51 = RegionIntersection(CurvesA=水面_3, CurvesB=汇水分区3)
rint_52 = RegionIntersection(CurvesA=下凹绿地_2, CurvesB=汇水分区3)
rint_53 = RegionIntersection(CurvesA=道路_3, CurvesB=汇水分区3)
rint_54 = RegionIntersection(CurvesA=机动车停车位_2, CurvesB=汇水分区3)
rint_55 = RegionIntersection(CurvesA=非机动车停车位_2, CurvesB=汇水分区3)
rint_56 = RegionIntersection(CurvesA=绿地_2, CurvesB=汇水分区3)
rint_57 = RegionIntersection(CurvesA=园路_2, CurvesB=汇水分区3)
rint_58 = RegionIntersection(CurvesA=活动广场_2, CurvesB=汇水分区3)
rint_59 = RegionIntersection(CurvesA=植草沟_2, CurvesB=汇水分区3)
rint_60 = RegionIntersection(CurvesA=用地红线, CurvesB=汇水分区3)
rint_61 = RegionIntersection(CurvesA=生物滞留设施_2, CurvesB=汇水分区3)
rint_62 = RegionIntersection(CurvesA=雨水花园_2, CurvesB=汇水分区3)
boundary_78 = BoundarySurfaces(Edges=rint_49)
boundary_79 = BoundarySurfaces(Edges=rint_50)
boundary_80 = BoundarySurfaces(Edges=rint_51)
boundary_81 = BoundarySurfaces(Edges=rint_52)
boundary_82 = BoundarySurfaces(Edges=rint_53)
boundary_83 = BoundarySurfaces(Edges=rint_54)
boundary_84 = BoundarySurfaces(Edges=rint_55)
boundary_85 = BoundarySurfaces(Edges=rint_56)
boundary_86 = BoundarySurfaces(Edges=rint_57)
boundary_87 = BoundarySurfaces(Edges=rint_58)
boundary_88 = BoundarySurfaces(Edges=rint_59)
boundary_89 = BoundarySurfaces(Edges=rint_60)
boundary_90 = BoundarySurfaces(Edges=rint_61)
boundary_91 = BoundarySurfaces(Edges=rint_62)
brep_77 = Brep(boundary_78)
brep_78 = Brep(boundary_79)
brep_79 = Brep(boundary_82)
brep_80 = Brep(boundary_84)
brep_81 = Brep(boundary_85)
brep_82 = Brep(boundary_86)
brep_83 = Brep(boundary_87)
brep_84 = Brep(boundary_83)
brep_85 = Brep(boundary_80)
brep_86 = Brep(boundary_89)
brep_87 = Brep(boundary_81)
brep_88 = Brep(boundary_88)
brep_89 = Brep(boundary_90)
brep_90 = Brep(boundary_91)
area_72 = Area(Geometry=brep_82)  # -> Area, Centroid
area_73 = Area(Geometry=brep_77)  # -> Area, Centroid
area_74 = Area(Geometry=brep_80)  # -> Area, Centroid
area_75 = Area(Geometry=brep_81)  # -> Area, Centroid
area_76 = Area(Geometry=brep_84)  # -> Area, Centroid
area_77 = Area(Geometry=brep_85)  # -> Area, Centroid
area_78 = Area(Geometry=brep_87)  # -> Area, Centroid
area_79 = Area(Geometry=brep_78)  # -> Area, Centroid
area_80 = Area(Geometry=brep_83)  # -> Area, Centroid
area_81 = Area(Geometry=brep_79)  # -> Area, Centroid
area_82 = Area(Geometry=brep_86)  # -> Area, Centroid
area_83 = Area(Geometry=brep_88)  # -> Area, Centroid
area_84 = Area(Geometry=brep_89)  # -> Area, Centroid
area_85 = Area(Geometry=brep_90)  # -> Area, Centroid
ma_83 = MassAddition(Input=area_72.Area)  # -> Result, PartialResults
ma_84 = MassAddition(Input=area_73.Area)  # -> Result, PartialResults
ma_85 = MassAddition(Input=area_74.Area)  # -> Result, PartialResults
ma_86 = MassAddition(Input=area_75.Area)  # -> Result, PartialResults
ma_87 = MassAddition(Input=area_76.Area)  # -> Result, PartialResults
ma_88 = MassAddition(Input=area_77.Area)  # -> Result, PartialResults
ma_89 = MassAddition(Input=area_78.Area)  # -> Result, PartialResults
ma_90 = MassAddition(Input=area_79.Area)  # -> Result, PartialResults
ma_91 = MassAddition(Input=area_80.Area)  # -> Result, PartialResults
ma_92 = MassAddition(Input=area_81.Area)  # -> Result, PartialResults
ma_93 = MassAddition(Input=area_83.Area)  # -> Result, PartialResults
ma_94 = MassAddition(Input=area_84.Area)  # -> Result, PartialResults
ma_95 = MassAddition(Input=area_85.Area)  # -> Result, PartialResults
下凹绿地_7 = Panel(ma_89.Result)
园路_12 = Panel(ma_83.Result)
非机动车停车位_9 = Panel(ma_85.Result)
植草沟_7 = Panel(ma_93.Result)
机动车停车位_9 = Panel(ma_87.Result)
活动广场_10 = Panel(ma_91.Result)
水面_13 = Panel(ma_88.Result)
绿化屋面_16 = Panel(ma_90.Result)
生物滞留设施_7 = Panel(ma_94.Result)
硬质屋面_13 = Panel(ma_84.Result)
道路_13 = Panel(ma_92.Result)
雨水花园_7 = Panel(ma_95.Result)
lid_sum_4 = Addition(A=下凹绿地_7, B=植草沟_7, C=雨水花园_7, D=生物滞留设施_7)
addition_31 = Addition(A=园路_12, B=lid_sum_4, C=0)
subtraction_13 = Subtraction(A=ma_86.Result, B=addition_31)
绿地_9 = Panel(subtraction_13)
merge_20 = Merge(
    Data1=硬质屋面_13,
    Data2=绿化屋面_16,
    Data3=道路_13,
    Data4=机动车停车位_9,
    Data5=非机动车停车位_9,
    Data6=绿地_9,
    Data7=园路_12,
    Data8=活动广场_10,
    Data9=水面_13,
    Data10=lid_sum_4)
ma_96 = MassAddition(Input=merge_20)  # -> Result, PartialResults
subtraction_14 = Subtraction(A=area_82.Area, B=ma_96.Result)
其他硬质铺装_7 = Panel(subtraction_14)

# ----
# 第三汇水分区
rint_63 = RegionIntersection(CurvesA=硬质屋面_2, CurvesB=汇水分区3)
rint_64 = RegionIntersection(CurvesA=水面_2, CurvesB=汇水分区3)
rint_65 = RegionIntersection(CurvesA=道路_2, CurvesB=汇水分区3)
rint_66 = RegionIntersection(CurvesA=机动车停车位, CurvesB=汇水分区3)
rint_67 = RegionIntersection(CurvesA=非机动车停车位, CurvesB=汇水分区3)
rint_68 = RegionIntersection(CurvesA=绿地, CurvesB=汇水分区3)
rint_69 = RegionIntersection(CurvesA=园路, CurvesB=汇水分区3)
rint_70 = RegionIntersection(CurvesA=活动广场, CurvesB=汇水分区3)
rint_71 = RegionIntersection(CurvesA=绿化屋面_2, CurvesB=汇水分区3)
rint_72 = RegionIntersection(CurvesA=用地红线, CurvesB=汇水分区3)
boundary_92 = BoundarySurfaces(Edges=rint_63)
boundary_93 = BoundarySurfaces(Edges=rint_64)
boundary_94 = BoundarySurfaces(Edges=rint_65)
boundary_95 = BoundarySurfaces(Edges=rint_66)
boundary_96 = BoundarySurfaces(Edges=rint_67)
boundary_97 = BoundarySurfaces(Edges=rint_68)
boundary_98 = BoundarySurfaces(Edges=rint_69)
boundary_99 = BoundarySurfaces(Edges=rint_70)
boundary_100 = BoundarySurfaces(Edges=rint_71)
boundary_101 = BoundarySurfaces(Edges=rint_72)
brep_91 = Brep(boundary_92)
brep_92 = Brep(boundary_94)
brep_93 = Brep(boundary_95)
brep_94 = Brep(boundary_96)
brep_95 = Brep(boundary_97)
brep_96 = Brep(boundary_98)
brep_97 = Brep(boundary_99)
brep_98 = Brep(boundary_93)
brep_99 = Brep(boundary_101)
brep_100 = Brep(boundary_100)
area_86 = Area(Geometry=brep_96)  # -> Area, Centroid
area_87 = Area(Geometry=brep_94)  # -> Area, Centroid
area_88 = Area(Geometry=brep_95)  # -> Area, Centroid
area_89 = Area(Geometry=brep_93)  # -> Area, Centroid
area_90 = Area(Geometry=brep_98)  # -> Area, Centroid
area_91 = Area(Geometry=brep_97)  # -> Area, Centroid
area_92 = Area(Geometry=brep_91)  # -> Area, Centroid
area_93 = Area(Geometry=brep_92)  # -> Area, Centroid
area_94 = Area(Geometry=brep_99)  # -> Area, Centroid
area_95 = Area(Geometry=brep_100)  # -> Area, Centroid
ma_97 = MassAddition(Input=area_86.Area)  # -> Result, PartialResults
ma_98 = MassAddition(Input=area_87.Area)  # -> Result, PartialResults
ma_99 = MassAddition(Input=area_88.Area)  # -> Result, PartialResults
ma_100 = MassAddition(Input=area_89.Area)  # -> Result, PartialResults
ma_101 = MassAddition(Input=area_90.Area)  # -> Result, PartialResults
ma_102 = MassAddition(Input=area_91.Area)  # -> Result, PartialResults
ma_103 = MassAddition(Input=area_92.Area)  # -> Result, PartialResults
ma_104 = MassAddition(Input=area_93.Area)  # -> Result, PartialResults
ma_105 = MassAddition(Input=area_95.Area)  # -> Result, PartialResults
园路_13 = Panel(ma_97.Result)
addition_32 = Addition(A=园路_13, B=0)
subtraction_15 = Subtraction(A=ma_99.Result, B=addition_32)
非机动车停车位_10 = Panel(ma_98.Result)
绿地_10 = Panel(subtraction_15)
机动车停车位_10 = Panel(ma_100.Result)
活动广场_11 = Panel(ma_102.Result)
水面_14 = Panel(ma_101.Result)
硬质屋面_14 = Panel(ma_103.Result)
绿化屋面_17 = Panel(ma_105.Result)
道路_14 = Panel(ma_104.Result)
merge_21 = Merge(
    Data1=硬质屋面_14,
    Data2=绿化屋面_17,
    Data3=道路_14,
    Data4=机动车停车位_10,
    Data5=非机动车停车位_10,
    Data6=绿地_10,
    Data7=园路_13,
    Data8=活动广场_11,
    Data9=水面_14)
ma_106 = MassAddition(Input=merge_21)  # -> Result, PartialResults
subtraction_16 = Subtraction(A=area_94.Area, B=ma_106.Result)
其他硬质铺装_8 = Panel(subtraction_16)

list_26 = ValueList({"硬质屋面": 0, "绿化屋面": 1, "硬质铺装": 2, "透水铺装": 3, "生态停车位": 4, "道路": 5, "普通绿地": 6, "水面": 7, "下凹绿地": 8, "植草沟": 9, "雨水花园": 10, "生物滞留设施": 11}, selected="硬质铺装")
item_31 = ListItem(List=merge, Index=list, Wrap=True)
item_32 = ListItem(List=merge, Index=list_2, Wrap=True)
item_33 = ListItem(List=merge, Index=list_3, Wrap=True)
item_34 = ListItem(List=merge, Index=list_4, Wrap=True)
item_35 = ListItem(List=merge, Index=list_8, Wrap=True)
item_36 = ListItem(List=merge, Index=list_6, Wrap=True)
item_37 = ListItem(List=merge, Index=list_7, Wrap=True)
item_38 = ListItem(List=merge, Index=list_9, Wrap=True)
item_39 = ListItem(List=merge, Index=list_5, Wrap=True)
item_40 = ListItem(List=merge, Index=list_26, Wrap=True)
eval_34 = Evaluate(F="x*y", x=硬质屋面_14, y=item_31)
eval_35 = Evaluate(F="x*y", x=绿化屋面_17, y=item_32)
eval_36 = Evaluate(F="x*y", x=道路_14, y=item_33)
eval_37 = Evaluate(F="x*y", x=机动车停车位_10, y=item_34)
eval_38 = Evaluate(F="x*y", x=活动广场_11, y=item_35)
eval_39 = Evaluate(F="x*y", x=绿地_10, y=item_36)
eval_40 = Evaluate(F="x*y", x=园路_13, y=item_37)
eval_41 = Evaluate(F="x*y", x=水面_14, y=item_38)
eval_42 = Evaluate(F="x*y", x=非机动车停车位_10, y=item_39)
eval_43 = Evaluate(F="x*y", x=其他硬质铺装_8, y=item_40)
sum_4 = Addition(A=eval_34, B=eval_35, C=eval_36, D=eval_37, E=eval_42, F=eval_39, G=eval_40, H=eval_38, I=eval_41, J=eval_43)
division_4 = Division(A=sum_4, B=area_94.Area)

# ----
# 第三汇水分区
# 汇总
# 综合径流系数
# 雨水设计径流总量
面积m2_4 = Panel(area_94.Area)
综合径流系数_4 = Panel(division_4)
eval_44 = Evaluate(F="10*x*y*z/10000", x=面积m2_4, y=综合径流系数_4, z=设计降雨量_mm)
雨水设计径流总量_m3_4 = Panel(eval_44)

# ----
# 下垫面面积统计
绿化屋面_18 = StreamGate(Stream=绿化屋面_17, Gate=list_2)  # -> Target0, Target1, Target2, Target3, Target4
机动车_4 = StreamGate(Stream=机动车停车位_10, Gate=list_4)  # -> Target0, Target1, Target2, Target3, Target4
非机动车_4 = StreamGate(Stream=非机动车停车位_10, Gate=list_5)  # -> Target0, Target1, Target2, Target3, Target4
园路_14 = StreamGate(Stream=园路_13, Gate=list_7)  # -> Target0, Target1, Target2, Target3, Target4
广场_3 = StreamGate(Stream=活动广场_11, Gate=list_8)  # -> Target0, Target1, Target2, Target3, Target4
merge_22 = Merge(Data1=机动车_4.Target3, Data2=非机动车_4.Target3, Data3=园路_14.Target3, Data4=广场_3.Target3)
merge_23 = Merge(Data1=机动车_4.Target2, Data2=非机动车_4.Target2, Data3=园路_14.Target2, Data4=广场_3.Target2)
merge_24 = Merge(Data1=机动车_4.Target4, Data2=非机动车_4.Target4, Data3=园路_14.Target4, Data4=广场_3.Target4)
addition_33 = Addition(A=硬质屋面_14, B=绿化屋面_18.Target0, C=0)
addition_34 = Addition(A=绿化屋面_18.Target1, B=0)
addition_35 = Addition(A=道路_14, B=0)
addition_36 = Addition(A=绿地_10, B=0)
addition_37 = Addition(A=水面_14, B=0)
ma_107 = MassAddition(Input=merge_23)  # -> Result, PartialResults
ma_108 = MassAddition(Input=merge_22)  # -> Result, PartialResults
ma_109 = MassAddition(Input=merge_24)  # -> Result, PartialResults
硬质屋面_15 = Panel(addition_33)
addition_38 = Addition(A=ma_108.Result, B=0)
addition_39 = Addition(A=ma_107.Result, B=其他硬质铺装_8)
绿化屋面_19 = Panel(addition_34)
addition_40 = Addition(A=ma_109.Result, B=0)
道路_15 = Panel(addition_35)
普通绿地_5 = Panel(addition_36)
水面_15 = Panel(addition_37)
透水铺装_6 = Panel(addition_38)
硬质铺装_5 = Panel(addition_39)
生态停车位_6 = Panel(addition_40)
无lid设施_4 = Panel("0")
merge_25 = Merge(
    Data1=flatten(硬质屋面_15),
    Data2=flatten(绿化屋面_19),
    Data3=flatten(道路_15),
    Data4=flatten(普通绿地_5),
    Data5=flatten(硬质铺装_5),
    Data6=flatten(透水铺装_6),
    Data7=flatten(生态停车位_6),
    Data8=flatten(水面_15),
    Data9=flatten(无lid设施_4),
    Data10=flatten(无lid设施_4),
    Data11=flatten(无lid设施_4),
    Data12=flatten(无lid设施_4),
    Data13=flatten(面积m2_4))

# ----
# 第四汇水分区
rint_73 = RegionIntersection(CurvesA=绿化屋面_3, CurvesB=汇水分区4)
rint_74 = RegionIntersection(CurvesA=硬质屋面_3, CurvesB=汇水分区4)
rint_75 = RegionIntersection(CurvesA=下凹绿地_2, CurvesB=汇水分区4)
rint_76 = RegionIntersection(CurvesA=道路_3, CurvesB=汇水分区4)
rint_77 = RegionIntersection(CurvesA=机动车停车位_2, CurvesB=汇水分区4)
rint_78 = RegionIntersection(CurvesA=非机动车停车位_2, CurvesB=汇水分区4)
rint_79 = RegionIntersection(CurvesA=绿地_2, CurvesB=汇水分区4)
rint_80 = RegionIntersection(CurvesA=园路_2, CurvesB=汇水分区4)
rint_81 = RegionIntersection(CurvesA=活动广场_2, CurvesB=汇水分区4)
rint_82 = RegionIntersection(CurvesA=植草沟_2, CurvesB=汇水分区4)
rint_83 = RegionIntersection(CurvesA=水面_3, CurvesB=汇水分区4)
rint_84 = RegionIntersection(CurvesA=用地红线, CurvesB=汇水分区4)
rint_85 = RegionIntersection(CurvesA=生物滞留设施_2, CurvesB=汇水分区4)
rint_86 = RegionIntersection(CurvesA=雨水花园_2, CurvesB=汇水分区4)
boundary_102 = BoundarySurfaces(Edges=rint_73)
boundary_103 = BoundarySurfaces(Edges=rint_74)
boundary_104 = BoundarySurfaces(Edges=rint_75)
boundary_105 = BoundarySurfaces(Edges=rint_76)
boundary_106 = BoundarySurfaces(Edges=rint_77)
boundary_107 = BoundarySurfaces(Edges=rint_78)
boundary_108 = BoundarySurfaces(Edges=rint_79)
boundary_109 = BoundarySurfaces(Edges=rint_80)
boundary_110 = BoundarySurfaces(Edges=rint_81)
boundary_111 = BoundarySurfaces(Edges=rint_82)
boundary_112 = BoundarySurfaces(Edges=rint_83)
boundary_113 = BoundarySurfaces(Edges=rint_84)
boundary_114 = BoundarySurfaces(Edges=rint_85)
boundary_115 = BoundarySurfaces(Edges=rint_86)
brep_101 = Brep(boundary_104)
brep_102 = Brep(boundary_111)
brep_103 = Brep(boundary_102)
brep_104 = Brep(boundary_114)
brep_105 = Brep(boundary_115)
brep_106 = Brep(boundary_103)
brep_107 = Brep(boundary_108)
brep_108 = Brep(boundary_113)
brep_109 = Brep(boundary_105)
brep_110 = Brep(boundary_106)
brep_111 = Brep(boundary_107)
brep_112 = Brep(boundary_109)
brep_113 = Brep(boundary_110)
brep_114 = Brep(boundary_112)
area_96 = Area(Geometry=brep_103)  # -> Area, Centroid
area_97 = Area(Geometry=brep_112)  # -> Area, Centroid
area_98 = Area(Geometry=brep_111)  # -> Area, Centroid
area_99 = Area(Geometry=brep_107)  # -> Area, Centroid
area_100 = Area(Geometry=brep_101)  # -> Area, Centroid
area_101 = Area(Geometry=brep_110)  # -> Area, Centroid
area_102 = Area(Geometry=brep_113)  # -> Area, Centroid
area_103 = Area(Geometry=brep_106)  # -> Area, Centroid
area_104 = Area(Geometry=brep_109)  # -> Area, Centroid
area_105 = Area(Geometry=brep_102)  # -> Area, Centroid
area_106 = Area(Geometry=brep_108)  # -> Area, Centroid
area_107 = Area(Geometry=brep_114)  # -> Area, Centroid
area_108 = Area(Geometry=brep_104)  # -> Area, Centroid
area_109 = Area(Geometry=brep_105)  # -> Area, Centroid
ma_110 = MassAddition(Input=area_96.Area)  # -> Result, PartialResults
ma_111 = MassAddition(Input=area_97.Area)  # -> Result, PartialResults
ma_112 = MassAddition(Input=area_98.Area)  # -> Result, PartialResults
ma_113 = MassAddition(Input=area_99.Area)  # -> Result, PartialResults
ma_114 = MassAddition(Input=area_100.Area)  # -> Result, PartialResults
ma_115 = MassAddition(Input=area_101.Area)  # -> Result, PartialResults
ma_116 = MassAddition(Input=area_102.Area)  # -> Result, PartialResults
ma_117 = MassAddition(Input=area_103.Area)  # -> Result, PartialResults
ma_118 = MassAddition(Input=area_104.Area)  # -> Result, PartialResults
ma_119 = MassAddition(Input=area_105.Area)  # -> Result, PartialResults
ma_120 = MassAddition(Input=area_107.Area)  # -> Result, PartialResults
ma_121 = MassAddition(Input=area_108.Area)  # -> Result, PartialResults
ma_122 = MassAddition(Input=area_109.Area)  # -> Result, PartialResults
下凹绿地_8 = Panel(ma_114.Result)
园路_15 = Panel(ma_111.Result)
植草沟_8 = Panel(ma_119.Result)
非机动车停车位_11 = Panel(ma_112.Result)
机动车停车位_11 = Panel(ma_115.Result)
活动广场_12 = Panel(ma_116.Result)
生物滞留设施_8 = Panel(ma_121.Result)
雨水花园_8 = Panel(ma_122.Result)
硬质屋面_16 = Panel(ma_117.Result)
绿化屋面_20 = Panel(ma_110.Result)
道路_16 = Panel(ma_118.Result)
水面_16 = Panel(ma_120.Result)
lid_sum_5 = Addition(A=下凹绿地_8, B=植草沟_8, C=雨水花园_8, D=生物滞留设施_8)
addition_41 = Addition(A=园路_15, B=lid_sum_5, C=0)
subtraction_17 = Subtraction(A=ma_113.Result, B=addition_41)
绿地_11 = Panel(subtraction_17)
merge_26 = Merge(
    Data1=硬质屋面_16,
    Data2=绿化屋面_20,
    Data3=道路_16,
    Data4=机动车停车位_11,
    Data5=非机动车停车位_11,
    Data6=绿地_11,
    Data7=园路_15,
    Data8=活动广场_12,
    Data9=水面_16,
    Data10=lid_sum_5)
ma_123 = MassAddition(Input=merge_26)  # -> Result, PartialResults
subtraction_18 = Subtraction(A=area_106.Area, B=ma_123.Result)
其他硬质铺装_9 = Panel(subtraction_18)

# ----
# 第四汇水分区
rint_87 = RegionIntersection(CurvesA=硬质屋面_2, CurvesB=汇水分区4)
rint_88 = RegionIntersection(CurvesA=绿化屋面_2, CurvesB=汇水分区4)
rint_89 = RegionIntersection(CurvesA=道路_2, CurvesB=汇水分区4)
rint_90 = RegionIntersection(CurvesA=机动车停车位, CurvesB=汇水分区4)
rint_91 = RegionIntersection(CurvesA=非机动车停车位, CurvesB=汇水分区4)
rint_92 = RegionIntersection(CurvesA=绿地, CurvesB=汇水分区4)
rint_93 = RegionIntersection(CurvesA=园路, CurvesB=汇水分区4)
rint_94 = RegionIntersection(CurvesA=活动广场, CurvesB=汇水分区4)
rint_95 = RegionIntersection(CurvesA=水面_2, CurvesB=汇水分区4)
rint_96 = RegionIntersection(CurvesA=用地红线, CurvesB=汇水分区4)
boundary_116 = BoundarySurfaces(Edges=rint_87)
boundary_117 = BoundarySurfaces(Edges=rint_88)
boundary_118 = BoundarySurfaces(Edges=rint_89)
boundary_119 = BoundarySurfaces(Edges=rint_90)
boundary_120 = BoundarySurfaces(Edges=rint_91)
boundary_121 = BoundarySurfaces(Edges=rint_92)
boundary_122 = BoundarySurfaces(Edges=rint_93)
boundary_123 = BoundarySurfaces(Edges=rint_94)
boundary_124 = BoundarySurfaces(Edges=rint_95)
boundary_125 = BoundarySurfaces(Edges=rint_96)
brep_115 = Brep(boundary_116)
brep_116 = Brep(boundary_117)
brep_117 = Brep(boundary_118)
brep_118 = Brep(boundary_120)
brep_119 = Brep(boundary_121)
brep_120 = Brep(boundary_122)
brep_121 = Brep(boundary_123)
brep_122 = Brep(boundary_119)
brep_123 = Brep(boundary_124)
brep_124 = Brep(boundary_125)
area_110 = Area(Geometry=brep_115)  # -> Area, Centroid
area_111 = Area(Geometry=brep_120)  # -> Area, Centroid
area_112 = Area(Geometry=brep_118)  # -> Area, Centroid
area_113 = Area(Geometry=brep_119)  # -> Area, Centroid
area_114 = Area(Geometry=brep_122)  # -> Area, Centroid
area_115 = Area(Geometry=brep_121)  # -> Area, Centroid
area_116 = Area(Geometry=brep_117)  # -> Area, Centroid
area_117 = Area(Geometry=brep_116)  # -> Area, Centroid
area_118 = Area(Geometry=brep_124)  # -> Area, Centroid
area_119 = Area(Geometry=brep_123)  # -> Area, Centroid
ma_124 = MassAddition(Input=area_110.Area)  # -> Result, PartialResults
ma_125 = MassAddition(Input=area_111.Area)  # -> Result, PartialResults
ma_126 = MassAddition(Input=area_112.Area)  # -> Result, PartialResults
ma_127 = MassAddition(Input=area_113.Area)  # -> Result, PartialResults
ma_128 = MassAddition(Input=area_114.Area)  # -> Result, PartialResults
addition_42 = Addition(A=ma_125.Result, B=0)
subtraction_19 = Subtraction(A=ma_127.Result, B=addition_42)
ma_129 = MassAddition(Input=area_115.Area)  # -> Result, PartialResults
ma_130 = MassAddition(Input=area_116.Area)  # -> Result, PartialResults
ma_131 = MassAddition(Input=area_117.Area)  # -> Result, PartialResults
ma_132 = MassAddition(Input=area_119.Area)  # -> Result, PartialResults
园路_16 = Panel(ma_125.Result)
非机动车停车位_12 = Panel(ma_126.Result)
绿地_12 = Panel(subtraction_19)
机动车停车位_12 = Panel(ma_128.Result)
活动广场_13 = Panel(ma_129.Result)
绿化屋面_21 = Panel(ma_131.Result)
硬质屋面_17 = Panel(ma_124.Result)
道路_17 = Panel(ma_130.Result)
水面_17 = Panel(ma_132.Result)
merge_27 = Merge(
    Data1=硬质屋面_17,
    Data2=绿化屋面_21,
    Data3=道路_17,
    Data4=机动车停车位_12,
    Data5=非机动车停车位_12,
    Data6=绿地_12,
    Data7=园路_16,
    Data8=活动广场_13,
    Data9=水面_17)
ma_133 = MassAddition(Input=merge_27)  # -> Result, PartialResults
subtraction_20 = Subtraction(A=area_118.Area, B=ma_133.Result)
其他硬质铺装_10 = Panel(subtraction_20)

list_27 = ValueList({"硬质屋面": 0, "绿化屋面": 1, "硬质铺装": 2, "透水铺装": 3, "生态停车位": 4, "道路": 5, "普通绿地": 6, "水面": 7, "下凹绿地": 8, "植草沟": 9, "雨水花园": 10, "生物滞留设施": 11}, selected="硬质铺装")
item_41 = ListItem(List=merge, Index=list, Wrap=True)
item_42 = ListItem(List=merge, Index=list_2, Wrap=True)
item_43 = ListItem(List=merge, Index=list_3, Wrap=True)
item_44 = ListItem(List=merge, Index=list_4, Wrap=True)
item_45 = ListItem(List=merge, Index=list_8, Wrap=True)
item_46 = ListItem(List=merge, Index=list_6, Wrap=True)
item_47 = ListItem(List=merge, Index=list_7, Wrap=True)
item_48 = ListItem(List=merge, Index=list_9, Wrap=True)
item_49 = ListItem(List=merge, Index=list_5, Wrap=True)
item_50 = ListItem(List=merge, Index=list_27, Wrap=True)
eval_45 = Evaluate(F="x*y", x=硬质屋面_17, y=item_41)
eval_46 = Evaluate(F="x*y", x=绿化屋面_21, y=item_42)
eval_47 = Evaluate(F="x*y", x=道路_17, y=item_43)
eval_48 = Evaluate(F="x*y", x=机动车停车位_12, y=item_44)
eval_49 = Evaluate(F="x*y", x=活动广场_13, y=item_45)
eval_50 = Evaluate(F="x*y", x=绿地_12, y=item_46)
eval_51 = Evaluate(F="x*y", x=园路_16, y=item_47)
eval_52 = Evaluate(F="x*y", x=水面_17, y=item_48)
eval_53 = Evaluate(F="x*y", x=非机动车停车位_12, y=item_49)
eval_54 = Evaluate(F="x*y", x=其他硬质铺装_10, y=item_50)
sum_5 = Addition(A=eval_45, B=eval_46, C=eval_47, D=eval_48, E=eval_53, F=eval_50, G=eval_51, H=eval_49, I=eval_52, J=eval_54)
division_5 = Division(A=sum_5, B=area_118.Area)

# ----
# 第四汇水分区
# 汇总
# 综合径流系数
# 雨水设计径流总量
综合径流系数_5 = Panel(division_5)
面积m2_5 = Panel(area_118.Area)
eval_55 = Evaluate(F="10*x*y*z/10000", x=面积m2_5, y=综合径流系数_5, z=设计降雨量_mm)
雨水设计径流总量_m3_5 = Panel(eval_55)

# ----
# 下垫面面积统计
绿化屋面_22 = StreamGate(Stream=绿化屋面_21, Gate=list_2)  # -> Target0, Target1, Target2, Target3, Target4
机动车_5 = StreamGate(Stream=机动车停车位_12, Gate=list_4)  # -> Target0, Target1, Target2, Target3, Target4
非机动车_5 = StreamGate(Stream=非机动车停车位_12, Gate=list_5)  # -> Target0, Target1, Target2, Target3, Target4
园路_17 = StreamGate(Stream=园路_16, Gate=list_7)  # -> Target0, Target1, Target2, Target3, Target4
广场_4 = StreamGate(Stream=活动广场_13, Gate=list_8)  # -> Target0, Target1, Target2, Target3, Target4
merge_28 = Merge(Data1=机动车_5.Target3, Data2=非机动车_5.Target3, Data3=园路_17.Target3, Data4=广场_4.Target3)
merge_29 = Merge(Data1=机动车_5.Target2, Data2=非机动车_5.Target2, Data3=园路_17.Target2, Data4=广场_4.Target2)
merge_30 = Merge(Data1=机动车_5.Target4, Data2=非机动车_5.Target4, Data3=园路_17.Target4, Data4=广场_4.Target4)
addition_43 = Addition(A=硬质屋面_17, B=绿化屋面_22.Target0, C=0)
addition_44 = Addition(A=绿化屋面_22.Target1, B=0)
addition_45 = Addition(A=道路_17, B=0)
addition_46 = Addition(A=绿地_12, B=0)
ma_134 = MassAddition(Input=merge_29)  # -> Result, PartialResults
ma_135 = MassAddition(Input=merge_28)  # -> Result, PartialResults
addition_47 = Addition(A=水面_17, B=0)
ma_136 = MassAddition(Input=merge_30)  # -> Result, PartialResults
addition_48 = Addition(A=ma_135.Result, B=0)
addition_49 = Addition(A=ma_134.Result, B=其他硬质铺装_10)
addition_50 = Addition(A=ma_136.Result, B=0)
水面_18 = Panel(addition_47)
硬质屋面_18 = Panel(addition_43)
绿化屋面_23 = Panel(addition_44)
道路_18 = Panel(addition_45)
普通绿地_6 = Panel(addition_46)
透水铺装_7 = Panel(addition_48)
硬质铺装_6 = Panel(addition_49)
生态停车位_7 = Panel(addition_50)
无lid设施_5 = Panel("0")
merge_31 = Merge(
    Data1=flatten(硬质屋面_18),
    Data2=flatten(绿化屋面_23),
    Data3=flatten(道路_18),
    Data4=flatten(普通绿地_6),
    Data5=flatten(硬质铺装_6),
    Data6=flatten(透水铺装_7),
    Data7=flatten(生态停车位_7),
    Data8=flatten(水面_18),
    Data9=flatten(无lid设施_5),
    Data10=flatten(无lid设施_5),
    Data11=flatten(无lid设施_5),
    Data12=flatten(无lid设施_5),
    Data13=flatten(面积m2_5))

# ----
# 第五汇水分区
rint_97 = RegionIntersection(CurvesA=硬质屋面_3, CurvesB=汇水分区5)
rint_98 = RegionIntersection(CurvesA=绿化屋面_3, CurvesB=汇水分区5)
rint_99 = RegionIntersection(CurvesA=下凹绿地_2, CurvesB=汇水分区5)
rint_100 = RegionIntersection(CurvesA=植草沟_2, CurvesB=汇水分区5)
rint_101 = RegionIntersection(CurvesA=用地红线, CurvesB=汇水分区5)
rint_102 = RegionIntersection(CurvesA=水面_3, CurvesB=汇水分区5)
rint_103 = RegionIntersection(CurvesA=道路_3, CurvesB=汇水分区5)
rint_104 = RegionIntersection(CurvesA=机动车停车位_2, CurvesB=汇水分区5)
rint_105 = RegionIntersection(CurvesA=非机动车停车位_2, CurvesB=汇水分区5)
rint_106 = RegionIntersection(CurvesA=绿地_2, CurvesB=汇水分区5)
rint_107 = RegionIntersection(CurvesA=园路_2, CurvesB=汇水分区5)
rint_108 = RegionIntersection(CurvesA=活动广场_2, CurvesB=汇水分区5)
rint_109 = RegionIntersection(CurvesA=生物滞留设施_2, CurvesB=汇水分区5)
rint_110 = RegionIntersection(CurvesA=雨水花园_2, CurvesB=汇水分区5)
boundary_126 = BoundarySurfaces(Edges=rint_97)
boundary_127 = BoundarySurfaces(Edges=rint_98)
boundary_128 = BoundarySurfaces(Edges=rint_99)
boundary_129 = BoundarySurfaces(Edges=rint_100)
boundary_130 = BoundarySurfaces(Edges=rint_101)
boundary_131 = BoundarySurfaces(Edges=rint_102)
boundary_132 = BoundarySurfaces(Edges=rint_103)
boundary_133 = BoundarySurfaces(Edges=rint_104)
boundary_134 = BoundarySurfaces(Edges=rint_105)
boundary_135 = BoundarySurfaces(Edges=rint_106)
boundary_136 = BoundarySurfaces(Edges=rint_107)
boundary_137 = BoundarySurfaces(Edges=rint_108)
boundary_138 = BoundarySurfaces(Edges=rint_109)
boundary_139 = BoundarySurfaces(Edges=rint_110)
brep_125 = Brep(boundary_126)
brep_126 = Brep(boundary_128)
brep_127 = Brep(boundary_129)
brep_128 = Brep(boundary_138)
brep_129 = Brep(boundary_127)
brep_130 = Brep(boundary_130)
brep_131 = Brep(boundary_139)
brep_132 = Brep(boundary_132)
brep_133 = Brep(boundary_134)
brep_134 = Brep(boundary_135)
brep_135 = Brep(boundary_136)
brep_136 = Brep(boundary_137)
brep_137 = Brep(boundary_133)
brep_138 = Brep(boundary_131)
area_120 = Area(Geometry=brep_125)  # -> Area, Centroid
area_121 = Area(Geometry=brep_126)  # -> Area, Centroid
area_122 = Area(Geometry=brep_129)  # -> Area, Centroid
area_123 = Area(Geometry=brep_130)  # -> Area, Centroid
area_124 = Area(Geometry=brep_135)  # -> Area, Centroid
area_125 = Area(Geometry=brep_127)  # -> Area, Centroid
area_126 = Area(Geometry=brep_133)  # -> Area, Centroid
area_127 = Area(Geometry=brep_134)  # -> Area, Centroid
area_128 = Area(Geometry=brep_137)  # -> Area, Centroid
area_129 = Area(Geometry=brep_138)  # -> Area, Centroid
area_130 = Area(Geometry=brep_136)  # -> Area, Centroid
area_131 = Area(Geometry=brep_128)  # -> Area, Centroid
area_132 = Area(Geometry=brep_132)  # -> Area, Centroid
area_133 = Area(Geometry=brep_131)  # -> Area, Centroid
ma_137 = MassAddition(Input=area_120.Area)  # -> Result, PartialResults
ma_138 = MassAddition(Input=area_121.Area)  # -> Result, PartialResults
ma_139 = MassAddition(Input=area_122.Area)  # -> Result, PartialResults
ma_140 = MassAddition(Input=area_124.Area)  # -> Result, PartialResults
ma_141 = MassAddition(Input=area_125.Area)  # -> Result, PartialResults
ma_142 = MassAddition(Input=area_126.Area)  # -> Result, PartialResults
ma_143 = MassAddition(Input=area_127.Area)  # -> Result, PartialResults
ma_144 = MassAddition(Input=area_128.Area)  # -> Result, PartialResults
ma_145 = MassAddition(Input=area_129.Area)  # -> Result, PartialResults
ma_146 = MassAddition(Input=area_130.Area)  # -> Result, PartialResults
ma_147 = MassAddition(Input=area_131.Area)  # -> Result, PartialResults
ma_148 = MassAddition(Input=area_132.Area)  # -> Result, PartialResults
ma_149 = MassAddition(Input=area_133.Area)  # -> Result, PartialResults
下凹绿地_9 = Panel(ma_138.Result)
植草沟_9 = Panel(ma_141.Result)
生物滞留设施_9 = Panel(ma_147.Result)
园路_18 = Panel(ma_140.Result)
雨水花园_9 = Panel(ma_149.Result)
非机动车停车位_13 = Panel(ma_142.Result)
绿地_13 = Panel(ma_143.Result)
机动车停车位_13 = Panel(ma_144.Result)
活动广场_14 = Panel(ma_146.Result)
水面_19 = Panel(ma_145.Result)
绿化屋面_24 = Panel(ma_139.Result)
道路_19 = Panel(ma_148.Result)
硬质屋面_19 = Panel(ma_137.Result)
lid_sum_6 = Addition(A=下凹绿地_9, B=植草沟_9, C=雨水花园_9, D=生物滞留设施_9)
merge_32 = Merge(
    Data1=硬质屋面_19,
    Data2=绿化屋面_24,
    Data3=道路_19,
    Data4=机动车停车位_13,
    Data5=非机动车停车位_13,
    Data6=绿地_13,
    Data7=园路_18,
    Data8=活动广场_14,
    Data9=水面_19,
    Data10=lid_sum_6)
ma_150 = MassAddition(Input=merge_32)  # -> Result, PartialResults
subtraction_21 = Subtraction(A=area_123.Area, B=ma_150.Result)
addition_51 = Addition(A=园路_18, B=lid_sum_6, C=0)
subtraction_22 = Subtraction(A=ma_143.Result, B=addition_51)
其他硬质铺装_11 = Panel(subtraction_21)

# ----
# 第五汇水分区
rint_111 = RegionIntersection(CurvesA=绿化屋面_2, CurvesB=汇水分区5)
rint_112 = RegionIntersection(CurvesA=用地红线, CurvesB=汇水分区5)
rint_113 = RegionIntersection(CurvesA=水面_2, CurvesB=汇水分区5)
rint_114 = RegionIntersection(CurvesA=道路_2, CurvesB=汇水分区5)
rint_115 = RegionIntersection(CurvesA=机动车停车位, CurvesB=汇水分区5)
rint_116 = RegionIntersection(CurvesA=非机动车停车位, CurvesB=汇水分区5)
rint_117 = RegionIntersection(CurvesA=绿地, CurvesB=汇水分区5)
rint_118 = RegionIntersection(CurvesA=园路, CurvesB=汇水分区5)
rint_119 = RegionIntersection(CurvesA=活动广场, CurvesB=汇水分区5)
rint_120 = RegionIntersection(CurvesA=硬质屋面_2, CurvesB=汇水分区5)
boundary_140 = BoundarySurfaces(Edges=rint_111)
boundary_141 = BoundarySurfaces(Edges=rint_112)
boundary_142 = BoundarySurfaces(Edges=rint_113)
boundary_143 = BoundarySurfaces(Edges=rint_114)
boundary_144 = BoundarySurfaces(Edges=rint_115)
boundary_145 = BoundarySurfaces(Edges=rint_116)
boundary_146 = BoundarySurfaces(Edges=rint_117)
boundary_147 = BoundarySurfaces(Edges=rint_118)
boundary_148 = BoundarySurfaces(Edges=rint_119)
boundary_149 = BoundarySurfaces(Edges=rint_120)
brep_139 = Brep(boundary_141)
brep_140 = Brep(boundary_140)
brep_141 = Brep(boundary_143)
brep_142 = Brep(boundary_144)
brep_143 = Brep(boundary_145)
brep_144 = Brep(boundary_146)
brep_145 = Brep(boundary_147)
brep_146 = Brep(boundary_148)
brep_147 = Brep(boundary_142)
brep_148 = Brep(boundary_149)
area_134 = Area(Geometry=brep_139)  # -> Area, Centroid
area_135 = Area(Geometry=brep_145)  # -> Area, Centroid
area_136 = Area(Geometry=brep_140)  # -> Area, Centroid
area_137 = Area(Geometry=brep_143)  # -> Area, Centroid
area_138 = Area(Geometry=brep_144)  # -> Area, Centroid
area_139 = Area(Geometry=brep_142)  # -> Area, Centroid
area_140 = Area(Geometry=brep_147)  # -> Area, Centroid
area_141 = Area(Geometry=brep_146)  # -> Area, Centroid
area_142 = Area(Geometry=brep_141)  # -> Area, Centroid
area_143 = Area(Geometry=brep_148)  # -> Area, Centroid
ma_151 = MassAddition(Input=area_135.Area)  # -> Result, PartialResults
ma_152 = MassAddition(Input=area_136.Area)  # -> Result, PartialResults
ma_153 = MassAddition(Input=area_137.Area)  # -> Result, PartialResults
ma_154 = MassAddition(Input=area_138.Area)  # -> Result, PartialResults
ma_155 = MassAddition(Input=area_139.Area)  # -> Result, PartialResults
ma_156 = MassAddition(Input=area_140.Area)  # -> Result, PartialResults
addition_52 = Addition(A=ma_151.Result, B=0)
subtraction_23 = Subtraction(A=ma_154.Result, B=addition_52)
ma_157 = MassAddition(Input=area_141.Area)  # -> Result, PartialResults
ma_158 = MassAddition(Input=area_142.Area)  # -> Result, PartialResults
ma_159 = MassAddition(Input=area_143.Area)  # -> Result, PartialResults
园路_19 = Panel(ma_151.Result)
非机动车停车位_14 = Panel(ma_153.Result)
绿地_14 = Panel(ma_154.Result)
机动车停车位_14 = Panel(ma_155.Result)
活动广场_15 = Panel(ma_157.Result)
水面_20 = Panel(ma_156.Result)
绿化屋面_25 = Panel(ma_152.Result)
道路_20 = Panel(ma_158.Result)
硬质屋面_20 = Panel(ma_159.Result)
merge_33 = Merge(
    Data1=硬质屋面_20,
    Data2=绿化屋面_25,
    Data3=道路_20,
    Data4=机动车停车位_14,
    Data5=非机动车停车位_14,
    Data6=绿地_14,
    Data7=园路_19,
    Data8=活动广场_15,
    Data9=水面_20)
ma_160 = MassAddition(Input=merge_33)  # -> Result, PartialResults
subtraction_24 = Subtraction(A=area_134.Area, B=ma_160.Result)
其他硬质铺装_12 = Panel(subtraction_24)

list_28 = ValueList({"硬质屋面": 0, "绿化屋面": 1, "硬质铺装": 2, "透水铺装": 3, "生态停车位": 4, "道路": 5, "普通绿地": 6, "水面": 7, "下凹绿地": 8, "植草沟": 9, "雨水花园": 10, "生物滞留设施": 11}, selected="硬质铺装")
item_51 = ListItem(List=merge, Index=list, Wrap=True)
item_52 = ListItem(List=merge, Index=list_2, Wrap=True)
item_53 = ListItem(List=merge, Index=list_3, Wrap=True)
item_54 = ListItem(List=merge, Index=list_4, Wrap=True)
item_55 = ListItem(List=merge, Index=list_8, Wrap=True)
item_56 = ListItem(List=merge, Index=list_6, Wrap=True)
item_57 = ListItem(List=merge, Index=list_7, Wrap=True)
item_58 = ListItem(List=merge, Index=list_9, Wrap=True)
item_59 = ListItem(List=merge, Index=list_5, Wrap=True)
item_60 = ListItem(List=merge, Index=list_28, Wrap=True)
eval_56 = Evaluate(F="x*y", x=硬质屋面_20, y=item_51)
eval_57 = Evaluate(F="x*y", x=绿化屋面_25, y=item_52)
eval_58 = Evaluate(F="x*y", x=道路_20, y=item_53)
eval_59 = Evaluate(F="x*y", x=机动车停车位_14, y=item_54)
eval_60 = Evaluate(F="x*y", x=活动广场_15, y=item_55)
eval_61 = Evaluate(F="x*y", x=绿地_14, y=item_56)
eval_62 = Evaluate(F="x*y", x=园路_19, y=item_57)
eval_63 = Evaluate(F="x*y", x=水面_20, y=item_58)
eval_64 = Evaluate(F="x*y", x=非机动车停车位_14, y=item_59)
eval_65 = Evaluate(F="x*y", x=其他硬质铺装_12, y=item_60)
sum_6 = Addition(A=eval_56, B=eval_57, C=eval_58, D=eval_59, E=eval_64, F=eval_61, G=eval_62, H=eval_60, I=eval_63, J=eval_65)
division_6 = Division(A=sum_6, B=area_134.Area)

# ----
# 第五汇水分区
# 汇总
# 综合径流系数
# 雨水设计径流总量
综合径流系数_6 = Panel(division_6)
面积m2_6 = Panel(area_134.Area)
eval_66 = Evaluate(F="10*x*y*z/10000", x=面积m2_6, y=综合径流系数_6, z=设计降雨量_mm)
雨水设计径流总量_m3_6 = Panel(eval_66)

# ----
# 下垫面面积统计
机动车_6 = StreamGate(Stream=机动车停车位_14, Gate=list_4)  # -> Target0, Target1, Target2, Target3, Target4
非机动车_6 = StreamGate(Stream=非机动车停车位_14, Gate=list_5)  # -> Target0, Target1, Target2, Target3, Target4
园路_20 = StreamGate(Stream=园路_19, Gate=list_7)  # -> Target0, Target1, Target2, Target3, Target4
广场_5 = StreamGate(Stream=活动广场_15, Gate=list_8)  # -> Target0, Target1, Target2, Target3, Target4
绿化屋面_26 = StreamGate(Stream=绿化屋面_25, Gate=list_2)  # -> Target0, Target1, Target2, Target3, Target4
merge_34 = Merge(Data1=机动车_6.Target3, Data2=非机动车_6.Target3, Data3=园路_20.Target3, Data4=广场_5.Target3)
merge_35 = Merge(Data1=机动车_6.Target2, Data2=非机动车_6.Target2, Data3=园路_20.Target2, Data4=广场_5.Target2)
merge_36 = Merge(Data1=机动车_6.Target4, Data2=非机动车_6.Target4, Data3=园路_20.Target4, Data4=广场_5.Target4)
addition_53 = Addition(A=硬质屋面_20, B=绿化屋面_26.Target0, C=0)
addition_54 = Addition(A=绿化屋面_26.Target1, B=0)
addition_55 = Addition(A=道路_20, B=0)
addition_56 = Addition(A=绿地_14, B=0)
ma_161 = MassAddition(Input=merge_35)  # -> Result, PartialResults
ma_162 = MassAddition(Input=merge_34)  # -> Result, PartialResults
ma_163 = MassAddition(Input=merge_36)  # -> Result, PartialResults
addition_57 = Addition(A=水面_20, B=0)
addition_58 = Addition(A=ma_162.Result, B=0)
addition_59 = Addition(A=ma_161.Result, B=其他硬质铺装_12)
addition_60 = Addition(A=ma_163.Result, B=0)
水面_21 = Panel(addition_57)
硬质屋面_21 = Panel(addition_53)
绿化屋面_27 = Panel(addition_54)
道路_21 = Panel(addition_55)
普通绿地_7 = Panel(addition_56)
透水铺装_8 = Panel(addition_58)
硬质铺装_7 = Panel(addition_59)
生态停车位_8 = Panel(addition_60)
无lid设施_6 = Panel("0")
merge_37 = Merge(
    Data1=flatten(硬质屋面_21),
    Data2=flatten(绿化屋面_27),
    Data3=flatten(道路_21),
    Data4=flatten(普通绿地_7),
    Data5=flatten(硬质铺装_7),
    Data6=flatten(透水铺装_8),
    Data7=flatten(生态停车位_8),
    Data8=flatten(水面_21),
    Data9=flatten(无lid设施_6),
    Data10=flatten(无lid设施_6),
    Data11=flatten(无lid设施_6),
    Data12=flatten(无lid设施_6),
    Data13=flatten(面积m2_6))

# ----
# 设计前
# 第二汇水分区
# 第三汇水分区
# 第五汇水分区
# 第四汇水分区
# 整个项目
# 第一汇水分区
# 面积 [m2]
# 面积 [m2]
# 面积 [m2]
# 面积 [m2]
# 面积 [m2]
# 面积 [m2]
# 径流系数
# 径流系数
# 径流系数
# 径流系数
# 径流系数
# 径流系数
# 硬质屋面
# 绿化屋面
# 道路
# 普通绿地
# 硬质铺装
# 透水铺装
# 生态停车位
# 水面
# 下凹绿地
# 植草沟
# 雨水花园
# 生物滞留设施
# 汇总
# 综合径流系数
# 雨水设计径流总量[m3]
matrix = ConstructMatrix(Rows=13, Columns=1, Values=merge_7)
matrix_2 = DisplayMatrix(matrix)
占位符 = Number(0)
merge_38 = Merge(
    Data1=硬质屋面,
    Data2=绿化屋面,
    Data3=道路,
    Data4=普通绿地,
    Data5=硬质铺装,
    Data6=透水铺装,
    Data7=生态停车位,
    Data8=水面,
    Data9=下凹绿地,
    Data10=植草沟,
    Data11=雨水花园,
    Data12=生物滞留设施,
    Data13=占位符,
    Data14=综合径流系数,
    Data15=雨水设计径流总量_m3)
matrix_3 = ConstructMatrix(Rows=15, Columns=1, Values=merge_38)
matrix_4 = DisplayMatrix(matrix_3)
matrix_5 = ConstructMatrix(Rows=13, Columns=1, Values=merge_13)
matrix_6 = DisplayMatrix(matrix_5)
占位符_2 = Number(0)
merge_39 = Merge(
    Data1=硬质屋面,
    Data2=绿化屋面,
    Data3=道路,
    Data4=普通绿地,
    Data5=硬质铺装,
    Data6=透水铺装,
    Data7=生态停车位,
    Data8=水面,
    Data9=下凹绿地,
    Data10=植草沟,
    Data11=雨水花园,
    Data12=生物滞留设施,
    Data13=占位符_2,
    Data14=flatten(综合径流系数_2),
    Data15=flatten(雨水设计径流总量_m3_2))
matrix_7 = ConstructMatrix(Rows=15, Columns=1, Values=merge_39)
matrix_8 = DisplayMatrix(matrix_7)
matrix_9 = ConstructMatrix(Rows=13, Columns=1, Values=merge_19)
matrix_10 = DisplayMatrix(matrix_9)
占位符_3 = Number(0)
merge_40 = Merge(
    Data1=硬质屋面,
    Data2=绿化屋面,
    Data3=道路,
    Data4=普通绿地,
    Data5=硬质铺装,
    Data6=透水铺装,
    Data7=生态停车位,
    Data8=水面,
    Data9=下凹绿地,
    Data10=植草沟,
    Data11=雨水花园,
    Data12=生物滞留设施,
    Data13=占位符_3,
    Data14=flatten(综合径流系数_3),
    Data15=flatten(雨水设计径流总量_m3_3))
matrix_11 = ConstructMatrix(Rows=15, Columns=1, Values=merge_40)
matrix_12 = DisplayMatrix(matrix_11)
matrix_13 = ConstructMatrix(Rows=13, Columns=1, Values=merge_25)
matrix_14 = DisplayMatrix(matrix_13)
占位符_4 = Number(0)
merge_41 = Merge(
    Data1=硬质屋面,
    Data2=绿化屋面,
    Data3=道路,
    Data4=普通绿地,
    Data5=硬质铺装,
    Data6=透水铺装,
    Data7=生态停车位,
    Data8=水面,
    Data9=下凹绿地,
    Data10=植草沟,
    Data11=雨水花园,
    Data12=生物滞留设施,
    Data13=占位符_4,
    Data14=flatten(综合径流系数_4),
    Data15=flatten(雨水设计径流总量_m3_4))
matrix_15 = ConstructMatrix(Rows=15, Columns=1, Values=merge_41)
matrix_16 = DisplayMatrix(matrix_15)
matrix_17 = ConstructMatrix(Rows=13, Columns=1, Values=merge_31)
matrix_18 = DisplayMatrix(matrix_17)
占位符_5 = Number(0)
merge_42 = Merge(
    Data1=硬质屋面,
    Data2=绿化屋面,
    Data3=道路,
    Data4=普通绿地,
    Data5=硬质铺装,
    Data6=透水铺装,
    Data7=生态停车位,
    Data8=水面,
    Data9=下凹绿地,
    Data10=植草沟,
    Data11=雨水花园,
    Data12=生物滞留设施,
    Data13=占位符_5,
    Data14=flatten(综合径流系数_5),
    Data15=flatten(雨水设计径流总量_m3_5))
matrix_19 = ConstructMatrix(Rows=15, Columns=1, Values=merge_42)
matrix_20 = DisplayMatrix(matrix_19)
matrix_21 = ConstructMatrix(Rows=13, Columns=1, Values=merge_37)
matrix_22 = DisplayMatrix(matrix_21)
占位符_6 = Number(0)
merge_43 = Merge(
    Data1=硬质屋面,
    Data2=绿化屋面,
    Data3=道路,
    Data4=普通绿地,
    Data5=硬质铺装,
    Data6=透水铺装,
    Data7=生态停车位,
    Data8=水面,
    Data9=下凹绿地,
    Data10=植草沟,
    Data11=雨水花园,
    Data12=生物滞留设施,
    Data13=占位符_6,
    Data14=flatten(综合径流系数_6),
    Data15=flatten(雨水设计径流总量_m3_6))
matrix_23 = ConstructMatrix(Rows=15, Columns=1, Values=merge_43)
matrix_24 = DisplayMatrix(matrix_23)

# ----
# 年径流污染物消减率
# 服务面积
# 各项措施面积占比
# 污染物去除率
# 污染物平均去除率
# 除以红线面积
下凹绿地_10 = Panel(下凹绿地_3)
植草沟_10 = Panel(植草沟_3)
透水铺装_9 = Panel(透水铺装_2)
生态停车位_9 = Panel(生态停车位_2)
雨水花园_10 = Panel(雨水花园_3)
生物滞留设施_10 = Panel(生物滞留设施_3)

# ----
# 年径流控制率计算
# 控制雨量 / 100%雨量 = 控制率
# 面积*（1-综合径流系数）*设计降雨量
# 红线面积*设计雨量=设计雨量
# 设计雨量/百分比=100%雨量
# 降雨量曲线视为线形，存在误差
expression = Expression(x=用地面积_m2, y=设计降雨量_mm, Expression="x*y/1000")
expression_2 = Expression(x=expression, y=年径流总量控制率, Expression="x/(y/100)")

# ----
# 整个地块
# 汇总
# 综合径流系数
# 雨水设计径流总量
面积m2_7 = Panel(用地面积_m2)

# ----
# 下垫面面积统计
# Gate输出口:
# 0:硬质屋面
# 1:绿化屋面
# 2:硬质铺装
# 3:透水铺装
# 4:生态停车位
gate = StreamGate(Stream=机动车停车位_4, Gate=list_13)  # -> Target0, Target1, Target2, Target3, Target4
gate_2 = StreamGate(Stream=非机动车停车位_4, Gate=list_14)  # -> Target0, Target1, Target2, Target3, Target4
gate_3 = StreamGate(Stream=园路_4, Gate=list_16)  # -> Target0, Target1, Target2, Target3, Target4
gate_4 = StreamGate(Stream=活动广场_4, Gate=list_17)  # -> Target0, Target1, Target2, Target3, Target4
绿化屋面_28 = StreamGate(Stream=绿化屋面_5, Gate=list_2)  # -> Target0, Target1, Target2, Target3, Target4
merge_44 = Merge(Data1=gate.Target3, Data2=gate_2.Target3, Data3=gate_3.Target3, Data4=gate_4.Target3)
merge_45 = Merge(Data1=gate.Target2, Data2=gate_2.Target2, Data3=gate_3.Target2, Data4=gate_4.Target2)
merge_46 = Merge(Data1=gate.Target4, Data2=gate_2.Target4, Data3=gate_3.Target4, Data4=gate_4.Target4)
addition_61 = Addition(A=硬质屋面_5, B=绿化屋面_28.Target0, C=0)
addition_62 = Addition(A=绿化屋面_28.Target1, B=0)
addition_63 = Addition(A=道路_5, B=0)
addition_64 = Addition(A=植草沟_4, B=0)
addition_65 = Addition(A=绿地_4, B=0)
addition_66 = Addition(A=下凹绿地_4, B=0)
addition_67 = Addition(A=雨水花园_4, B=0)
addition_68 = Addition(A=生物滞留设施_4, B=0)
ma_164 = MassAddition(Input=merge_45)  # -> Result, PartialResults
addition_69 = Addition(A=水面_5, B=0)
ma_165 = MassAddition(Input=merge_44)  # -> Result, PartialResults
ma_166 = MassAddition(Input=merge_46)  # -> Result, PartialResults
addition_70 = Addition(A=ma_165.Result, B=0)
植草沟_11 = Panel(addition_64)
生物滞留设施_11 = Panel(addition_68)
addition_71 = Addition(A=ma_164.Result, B=其他硬质铺装_2)
雨水花园_11 = Panel(addition_67)
下凹绿地_11 = Panel(addition_66)
addition_72 = Addition(A=ma_166.Result, B=0)
水面_22 = Panel(addition_69)
硬质屋面_22 = Panel(addition_61)
绿化屋面_29 = Panel(addition_62)
透水铺装_10 = Panel(addition_70)
道路_22 = Panel(addition_63)
硬质铺装_8 = Panel(addition_71)
普通绿地_8 = Panel(addition_65)
生态停车位_10 = Panel(addition_72)
merge_47 = Merge(
    Data1=flatten(硬质屋面_22),
    Data2=flatten(绿化屋面_29),
    Data3=flatten(道路_22),
    Data4=flatten(普通绿地_8),
    Data5=flatten(硬质铺装_8),
    Data6=flatten(透水铺装_10),
    Data7=flatten(生态停车位_10),
    Data8=flatten(水面_22),
    Data9=flatten(下凹绿地_11),
    Data10=flatten(植草沟_11),
    Data11=flatten(雨水花园_11),
    Data12=flatten(生物滞留设施_11),
    Data13=flatten(面积m2_7))

# ----
# 乘以有效系数
list_29 = ValueList({"硬质屋面": 0, "绿化屋面": 1, "硬质铺装": 2, "透水铺装": 3, "生态停车位": 4, "道路": 5, "普通绿地": 6, "水面": 7, "下凹绿地": 8, "植草沟": 9, "雨水花园": 10, "生物滞留设施": 11}, selected="硬质铺装")
item_61 = ListItem(List=merge, Index=list_29, Wrap=True)
item_62 = ListItem(List=merge, Index=list_19, Wrap=True)
item_63 = ListItem(List=merge, Index=list_20, Wrap=True)
item_64 = ListItem(List=merge, Index=list_22, Wrap=True)
item_65 = ListItem(List=merge, Index=list_21, Wrap=True)
item_66 = ListItem(List=merge, Index=list_10, Wrap=True)
item_67 = ListItem(List=merge, Index=list_11, Wrap=True)
item_68 = ListItem(List=merge, Index=list_12, Wrap=True)
item_69 = ListItem(List=merge, Index=list_13, Wrap=True)
item_70 = ListItem(List=merge, Index=list_17, Wrap=True)
item_71 = ListItem(List=merge, Index=list_15, Wrap=True)
item_72 = ListItem(List=merge, Index=list_16, Wrap=True)
item_73 = ListItem(List=merge, Index=list_18, Wrap=True)
item_74 = ListItem(List=merge, Index=list_14, Wrap=True)
eval_67 = Evaluate(F="x*y", x=硬质屋面_5, y=item_66)
eval_68 = Evaluate(F="x*y", x=绿化屋面_5, y=item_67)
eval_69 = Evaluate(F="x*y", x=道路_5, y=item_68)
eval_70 = Evaluate(F="x*y", x=机动车停车位_4, y=item_69)
eval_71 = Evaluate(F="x*y", x=活动广场_4, y=item_70)
eval_72 = Evaluate(F="x*y", x=绿地_4, y=item_71)
eval_73 = Evaluate(F="x*y", x=园路_4, y=item_72)
eval_74 = Evaluate(F="x*y", x=水面_5, y=item_73)
eval_75 = Evaluate(F="x*y", x=非机动车停车位_4, y=item_74)
eval_76 = Evaluate(F="x*y", x=其他硬质铺装_2, y=item_61)
eval_77 = Evaluate(F="x*y", x=下凹绿地_4, y=item_62)
eval_78 = Evaluate(F="x*y", x=植草沟_4, y=item_63)
eval_79 = Evaluate(F="x*y", x=雨水花园_4, y=item_64)
eval_80 = Evaluate(F="x*y", x=生物滞留设施_4, y=item_65)
sum_7 = Addition(
    A=eval_67,
    B=eval_68,
    C=eval_69,
    D=eval_70,
    E=eval_75,
    F=eval_72,
    G=eval_73,
    H=eval_71,
    I=eval_74,
    J=eval_76,
    K=eval_77,
    L=eval_78,
    M=eval_79,
    N=eval_80)
division_7 = Division(A=sum_7, B=用地面积_m2)
multiplication = Multiplication(A=下凹绿地_11, B=深度m)
multiplication_2 = Multiplication(A=植草沟_11, B=深度m_2)
multiplication_3 = Multiplication(A=雨水花园_11, B=深度m_3)
multiplication_4 = Multiplication(A=生物滞留设施_11, B=深度m_4)
multiplication_5 = Multiplication(A=multiplication, B=有效系数)
multiplication_6 = Multiplication(A=multiplication_2, B=有效系数_2)
multiplication_7 = Multiplication(A=multiplication_3, B=有效系数_3)
multiplication_8 = Multiplication(A=multiplication_4, B=有效系数_4)
下凹绿地控制雨水量 = Panel(multiplication_5)
植草沟控制雨水量 = Panel(multiplication_6)
雨水花园控制雨水量 = Panel(multiplication_7)
生物滞留设施控制雨水量 = Panel(multiplication_8)
sum_8 = Addition(A=下凹绿地控制雨水量, B=植草沟控制雨水量, C=雨水花园控制雨水量, D=生物滞留设施控制雨水量)

综合径流系数_7 = Panel(division_7)
eval_81 = Evaluate(F="10*x*y*z/10000", x=面积m2_7, y=综合径流系数_7, z=设计降雨量_mm)
雨水设计径流总量_m3_7 = Panel(eval_81)

expression_3 = Expression(x=面积m2_7, y=综合径流系数_7, z=设计降雨量_mm, Expression="x*(1-y)*z/1000")
expression_4 = Expression(x=sum_8, y=expression_3, z=expression_2, Expression="(x+y)/z*100")

# ----
# 设计后
# 第二汇水分区
# 第三汇水分区
# 第五汇水分区
# 第四汇水分区
# 整个项目
# 第一汇水分区
# 面积 [m2]
# 面积 [m2]
# 面积 [m2]
# 面积 [m2]
# 面积 [m2]
# 面积 [m2]
# 径流系数
# 径流系数
# 下垫面类型
# 径流系数
# 径流系数
# 径流系数
# 径流系数
# 硬质屋面
# 绿化屋面
# 道路
# 普通绿地
# 硬质铺装
# 透水铺装
# 生态停车位
# 水面
# 下凹绿地
# 植草沟
# 雨水花园
# 生物滞留设施
# 汇总
# 综合径流系数
# 雨水设计径流总量[m3]
# LID控制雨水量[m3]
# 年径流总量控制率%
年径流总量控制率_2 = Panel(expression_4)
matrix_25 = ConstructMatrix(Rows=13, Columns=1, Values=merge_47)
matrix_26 = DisplayMatrix(matrix_25)
lid控制雨水量_m3 = Panel(sum_8)
merge_48 = Merge(
    Data1=硬质屋面,
    Data2=绿化屋面,
    Data3=道路,
    Data4=普通绿地,
    Data5=硬质铺装,
    Data6=透水铺装,
    Data7=生态停车位,
    Data8=水面,
    Data9=下凹绿地,
    Data10=植草沟,
    Data11=雨水花园,
    Data12=生物滞留设施,
    Data13=0,
    Data14=综合径流系数_7,
    Data15=雨水设计径流总量_m3_7)
matrix_27 = ConstructMatrix(Rows=15, Columns=1, Values=merge_48)
matrix_28 = DisplayMatrix(matrix_27)

下凹绿地_12 = Panel(下凹绿地_11)
植草沟_12 = Panel(植草沟_11)
雨水花园_12 = Panel(雨水花园_11)
生物滞留设施_12 = Panel(生物滞留设施_11)
透水铺装_11 = Panel(透水铺装_10)
生态停车位_11 = Panel(生态停车位_10)
ma_167 = MassAddition(Input=[透水铺装_11, 生态停车位_11, 下凹绿地_12, 植草沟_12, 雨水花园_12, 生物滞留设施_12])  # -> Result, PartialResults
汇总 = Panel(ma_167.Result)
division_8 = Division(A=生物滞留设施_12, B=用地面积_m2)
division_9 = Division(A=植草沟_12, B=用地面积_m2)
division_10 = Division(A=雨水花园_12, B=用地面积_m2)
division_11 = Division(A=生态停车位_11, B=用地面积_m2)
division_12 = Division(A=下凹绿地_12, B=用地面积_m2)
division_13 = Division(A=透水铺装_11, B=用地面积_m2)
下凹绿地_13 = Panel(division_12)
植草沟_13 = Panel(division_9)
透水铺装_12 = Panel(division_13)
生态停车位_12 = Panel(division_11)
雨水花园_13 = Panel(division_10)
生物滞留设施_13 = Panel(division_8)
ma_168 = MassAddition(Input=[透水铺装_12, 生态停车位_12, 下凹绿地_13, 植草沟_13, 雨水花园_13, 生物滞留设施_13])  # -> Result, PartialResults
汇总_2 = Panel(ma_168.Result)
expression_5 = Expression(x=透水铺装_11, y=透水铺装_9, z=汇总, Expression="x*y/z")
expression_6 = Expression(x=生态停车位_11, y=生态停车位_9, z=汇总, Expression="x*y/z")
expression_7 = Expression(x=下凹绿地_12, y=下凹绿地_10, z=汇总, Expression="x*y/z")
expression_8 = Expression(x=植草沟_12, y=植草沟_10, z=汇总, Expression="x*y/z")
expression_9 = Expression(x=division_10, y=雨水花园_10, z=汇总, Expression="x*y/z")
expression_10 = Expression(x=生物滞留设施_12, y=生物滞留设施_10, z=汇总, Expression="x*y/z")
下凹绿地_14 = Panel(expression_7)
植草沟_14 = Panel(expression_8)
透水铺装_13 = Panel(expression_5)
生态停车位_13 = Panel(expression_6)
雨水花园_14 = Panel(expression_9)
生物滞留设施_14 = Panel(expression_10)
ma_169 = MassAddition(Input=[透水铺装_13, 生态停车位_13, 下凹绿地_14, 植草沟_14, 雨水花园_14, 生物滞留设施_14])  # -> Result, PartialResults
汇总_3 = Panel(ma_169.Result)
expression_11 = Expression(x=汇总_3, y=年径流总量控制率_2, Expression="x*y")
年径流污染物消减率 = Panel(expression_11)

# ----
# 第一汇水分区
# 汇总
# 综合径流系数
# 雨水设计径流总量
面积m2_8 = Panel(area_47.Area)

# ----
# 下垫面面积统计
机动车_7 = StreamGate(Stream=机动车停车位_6, Gate=list_13)  # -> Target0, Target1, Target2, Target3, Target4
非机动车_7 = StreamGate(Stream=非机动车停车位_6, Gate=list_14)  # -> Target0, Target1, Target2, Target3, Target4
园路_21 = StreamGate(Stream=园路_7, Gate=list_16)  # -> Target0, Target1, Target2, Target3, Target4
广场_6 = StreamGate(Stream=活动广场_7, Gate=list_17)  # -> Target0, Target1, Target2, Target3, Target4
绿化屋面_30 = StreamGate(Stream=绿化屋面_9, Gate=list_2)  # -> Target0, Target1, Target2, Target3, Target4
merge_49 = Merge(Data1=机动车_7.Target3, Data2=非机动车_7.Target3, Data3=园路_21.Target3, Data4=广场_6.Target3)
merge_50 = Merge(Data1=机动车_7.Target2, Data2=非机动车_7.Target2, Data3=园路_21.Target2, Data4=广场_6.Target2)
merge_51 = Merge(Data1=机动车_7.Target4, Data2=非机动车_7.Target4, Data3=园路_21.Target4, Data4=广场_6.Target4)
addition_73 = Addition(A=硬质屋面_8, B=绿化屋面_30.Target0, C=0)
addition_74 = Addition(A=绿化屋面_30.Target1, B=0)
addition_75 = Addition(A=道路_8, B=0)
addition_76 = Addition(A=绿地_6, B=0)
ma_170 = MassAddition(Input=merge_50)  # -> Result, PartialResults
ma_171 = MassAddition(Input=merge_49)  # -> Result, PartialResults
addition_77 = Addition(A=水面_8, B=0)
ma_172 = MassAddition(Input=merge_51)  # -> Result, PartialResults
addition_78 = Addition(A=植草沟_5, B=0)
addition_79 = Addition(A=雨水花园_5, B=0)
addition_80 = Addition(A=下凹绿地_5, B=0)
addition_81 = Addition(A=生物滞留设施_5, B=0)
addition_82 = Addition(A=ma_171.Result, B=0)
addition_83 = Addition(A=ma_170.Result, B=其他硬质铺装_4)
addition_84 = Addition(A=ma_172.Result, B=0)
水面_23 = Panel(addition_77)
下凹绿地_15 = Panel(addition_80)
植草沟_15 = Panel(addition_78)
雨水花园_15 = Panel(addition_79)
生物滞留设施_15 = Panel(addition_81)
硬质屋面_23 = Panel(addition_73)
绿化屋面_31 = Panel(addition_74)
透水铺装_14 = Panel(addition_82)
硬质铺装_9 = Panel(addition_83)
道路_23 = Panel(addition_75)
普通绿地_9 = Panel(addition_76)
生态停车位_14 = Panel(addition_84)
merge_52 = Merge(
    Data1=flatten(硬质屋面_23),
    Data2=flatten(绿化屋面_31),
    Data3=flatten(道路_23),
    Data4=flatten(普通绿地_9),
    Data5=flatten(硬质铺装_9),
    Data6=flatten(透水铺装_14),
    Data7=flatten(生态停车位_14),
    Data8=flatten(水面_23),
    Data9=flatten(下凹绿地_15),
    Data10=flatten(植草沟_15),
    Data11=flatten(雨水花园_15),
    Data12=flatten(生物滞留设施_15),
    Data13=flatten(面积m2_8))

list_30 = ValueList({"硬质屋面": 0, "绿化屋面": 1, "硬质铺装": 2, "透水铺装": 3, "生态停车位": 4, "道路": 5, "普通绿地": 6, "水面": 7, "下凹绿地": 8, "植草沟": 9, "雨水花园": 10, "生物滞留设施": 11}, selected="硬质铺装")
item_75 = ListItem(List=merge, Index=list_10, Wrap=True)
item_76 = ListItem(List=merge, Index=list_11, Wrap=True)
item_77 = ListItem(List=merge, Index=list_12, Wrap=True)
item_78 = ListItem(List=merge, Index=list_13, Wrap=True)
item_79 = ListItem(List=merge, Index=list_17, Wrap=True)
item_80 = ListItem(List=merge, Index=list_15, Wrap=True)
item_81 = ListItem(List=merge, Index=list_16, Wrap=True)
item_82 = ListItem(List=merge, Index=list_18, Wrap=True)
item_83 = ListItem(List=merge, Index=list_14, Wrap=True)
item_84 = ListItem(List=merge, Index=list_30, Wrap=True)
item_85 = ListItem(List=merge, Index=list_19, Wrap=True)
item_86 = ListItem(List=merge, Index=list_20, Wrap=True)
item_87 = ListItem(List=merge, Index=list_22, Wrap=True)
item_88 = ListItem(List=merge, Index=list_21, Wrap=True)
eval_82 = Evaluate(F="x*y", x=硬质屋面_8, y=item_75)
eval_83 = Evaluate(F="x*y", x=绿化屋面_9, y=item_76)
eval_84 = Evaluate(F="x*y", x=道路_8, y=item_77)
eval_85 = Evaluate(F="x*y", x=机动车停车位_6, y=item_78)
eval_86 = Evaluate(F="x*y", x=活动广场_7, y=item_79)
eval_87 = Evaluate(F="x*y", x=绿地_6, y=item_80)
eval_88 = Evaluate(F="x*y", x=园路_7, y=item_81)
eval_89 = Evaluate(F="x*y", x=水面_8, y=item_82)
eval_90 = Evaluate(F="x*y", x=非机动车停车位_6, y=item_83)
eval_91 = Evaluate(F="x*y", x=其他硬质铺装_4, y=item_84)
eval_92 = Evaluate(F="x*y", x=下凹绿地_5, y=item_85)
eval_93 = Evaluate(F="x*y", x=植草沟_5, y=item_86)
eval_94 = Evaluate(F="x*y", x=雨水花园_5, y=item_87)
eval_95 = Evaluate(F="x*y", x=生物滞留设施_5, y=item_88)
sum_9 = Addition(
    A=eval_82,
    B=eval_83,
    C=eval_84,
    D=eval_85,
    E=eval_90,
    F=eval_87,
    G=eval_88,
    H=eval_86,
    I=eval_89,
    J=eval_91,
    K=eval_92,
    L=eval_93,
    M=eval_94,
    N=eval_95)
division_14 = Division(A=sum_9, B=area_47.Area)
multiplication_9 = Multiplication(A=下凹绿地_15, B=深度m)
multiplication_10 = Multiplication(A=植草沟_15, B=深度m_2)
multiplication_11 = Multiplication(A=雨水花园_15, B=深度m_3)
multiplication_12 = Multiplication(A=生物滞留设施_15, B=深度m_4)
multiplication_13 = Multiplication(A=multiplication_9, B=有效系数)
multiplication_14 = Multiplication(A=multiplication_10, B=有效系数_2)
multiplication_15 = Multiplication(A=multiplication_11, B=有效系数_3)
multiplication_16 = Multiplication(A=multiplication_12, B=有效系数_4)
下凹绿地控制雨水量_2 = Panel(multiplication_13)
植草沟控制雨水量_2 = Panel(multiplication_14)
雨水花园控制雨水量_2 = Panel(multiplication_15)
生物滞留设施控制雨水量_2 = Panel(multiplication_16)
sum_10 = Addition(A=下凹绿地控制雨水量_2, B=植草沟控制雨水量_2, C=雨水花园控制雨水量_2, D=生物滞留设施控制雨水量_2)

综合径流系数_8 = Panel(division_14)
eval_96 = Evaluate(F="10*x*y*z/10000", x=面积m2_8, y=综合径流系数_8, z=设计降雨量_mm)
雨水设计径流总量_m3_8 = Panel(eval_96)

matrix_29 = ConstructMatrix(Rows=13, Columns=1, Values=merge_52)
matrix_30 = DisplayMatrix(matrix_29)
lid控制雨水量_m3_2 = Panel(sum_10)
merge_53 = Merge(
    Data1=硬质屋面,
    Data2=绿化屋面,
    Data3=道路,
    Data4=普通绿地,
    Data5=硬质铺装,
    Data6=透水铺装,
    Data7=生态停车位,
    Data8=水面,
    Data9=下凹绿地,
    Data10=植草沟,
    Data11=雨水花园,
    Data12=生物滞留设施,
    Data13=0,
    Data14=flatten(综合径流系数_8),
    Data15=flatten(雨水设计径流总量_m3_8))
matrix_31 = ConstructMatrix(Rows=15, Columns=1, Values=merge_53)
matrix_32 = DisplayMatrix(matrix_31)

# ----
# 第二汇水分区
# 汇总
# 综合径流系数
# 雨水设计径流总量
面积m2_9 = Panel(area_57.Area)

# ----
# 下垫面面积统计
机动车_8 = StreamGate(Stream=机动车停车位_7, Gate=list_13)  # -> Target0, Target1, Target2, Target3, Target4
非机动车_8 = StreamGate(Stream=非机动车停车位_7, Gate=list_14)  # -> Target0, Target1, Target2, Target3, Target4
园路_22 = StreamGate(Stream=园路_9, Gate=list_16)  # -> Target0, Target1, Target2, Target3, Target4
广场_7 = StreamGate(Stream=活动广场_8, Gate=list_17)  # -> Target0, Target1, Target2, Target3, Target4
绿化屋面_32 = StreamGate(Stream=绿化屋面_12, Gate=list_2)  # -> Target0, Target1, Target2, Target3, Target4
merge_54 = Merge(Data1=机动车_8.Target3, Data2=非机动车_8.Target3, Data3=园路_22.Target3, Data4=广场_7.Target3)
merge_55 = Merge(Data1=机动车_8.Target2, Data2=非机动车_8.Target2, Data3=园路_22.Target2, Data4=广场_7.Target2)
merge_56 = Merge(Data1=机动车_8.Target4, Data2=非机动车_8.Target4, Data3=园路_22.Target4, Data4=广场_7.Target4)
addition_85 = Addition(A=硬质屋面_10, B=绿化屋面_32.Target0, C=0)
addition_86 = Addition(A=绿化屋面_32.Target1, B=0)
addition_87 = Addition(A=道路_10, B=0)
addition_88 = Addition(A=绿地_7, B=0)
ma_173 = MassAddition(Input=merge_55)  # -> Result, PartialResults
ma_174 = MassAddition(Input=merge_54)  # -> Result, PartialResults
ma_175 = MassAddition(Input=merge_56)  # -> Result, PartialResults
addition_89 = Addition(A=水面_10, B=0)
addition_90 = Addition(A=植草沟_6, B=0)
addition_91 = Addition(A=雨水花园_6, B=0)
addition_92 = Addition(A=下凹绿地_6, B=0)
addition_93 = Addition(A=生物滞留设施_6, B=0)
addition_94 = Addition(A=ma_174.Result, B=0)
addition_95 = Addition(A=ma_173.Result, B=其他硬质铺装_5)
addition_96 = Addition(A=ma_175.Result, B=0)
水面_24 = Panel(addition_89)
下凹绿地_16 = Panel(addition_92)
植草沟_16 = Panel(addition_90)
雨水花园_16 = Panel(addition_91)
生物滞留设施_16 = Panel(addition_93)
硬质屋面_24 = Panel(addition_85)
绿化屋面_33 = Panel(addition_86)
道路_24 = Panel(addition_87)
普通绿地_10 = Panel(addition_88)
透水铺装_15 = Panel(addition_94)
硬质铺装_10 = Panel(addition_95)
生态停车位_15 = Panel(addition_96)
merge_57 = Merge(
    Data1=flatten(硬质屋面_24),
    Data2=flatten(绿化屋面_33),
    Data3=flatten(道路_24),
    Data4=flatten(普通绿地_10),
    Data5=flatten(硬质铺装_10),
    Data6=flatten(透水铺装_15),
    Data7=flatten(生态停车位_15),
    Data8=flatten(水面_24),
    Data9=flatten(下凹绿地_16),
    Data10=flatten(植草沟_16),
    Data11=flatten(雨水花园_16),
    Data12=flatten(生物滞留设施_16),
    Data13=flatten(面积m2_9))

# ----
# 第二汇水分区
list_31 = ValueList({"硬质屋面": 0, "绿化屋面": 1, "硬质铺装": 2, "透水铺装": 3, "生态停车位": 4, "道路": 5, "普通绿地": 6, "水面": 7, "下凹绿地": 8, "植草沟": 9, "雨水花园": 10, "生物滞留设施": 11}, selected="硬质铺装")
item_89 = ListItem(List=merge, Index=list_10, Wrap=True)
item_90 = ListItem(List=merge, Index=list_11, Wrap=True)
item_91 = ListItem(List=merge, Index=list_12, Wrap=True)
item_92 = ListItem(List=merge, Index=list_13, Wrap=True)
item_93 = ListItem(List=merge, Index=list_17, Wrap=True)
item_94 = ListItem(List=merge, Index=list_19, Wrap=True)
item_95 = ListItem(List=merge, Index=list_20, Wrap=True)
item_96 = ListItem(List=merge, Index=list_22, Wrap=True)
item_97 = ListItem(List=merge, Index=list_21, Wrap=True)
item_98 = ListItem(List=merge, Index=list_15, Wrap=True)
item_99 = ListItem(List=merge, Index=list_16, Wrap=True)
item_100 = ListItem(List=merge, Index=list_18, Wrap=True)
item_101 = ListItem(List=merge, Index=list_14, Wrap=True)
item_102 = ListItem(List=merge, Index=list_31, Wrap=True)
eval_97 = Evaluate(F="x*y", x=硬质屋面_10, y=item_89)
eval_98 = Evaluate(F="x*y", x=绿化屋面_12, y=item_90)
eval_99 = Evaluate(F="x*y", x=道路_10, y=item_91)
eval_100 = Evaluate(F="x*y", x=机动车停车位_7, y=item_92)
eval_101 = Evaluate(F="x*y", x=活动广场_8, y=item_93)
eval_102 = Evaluate(F="x*y", x=下凹绿地_6, y=item_94)
eval_103 = Evaluate(F="x*y", x=植草沟_6, y=item_95)
eval_104 = Evaluate(F="x*y", x=雨水花园_6, y=item_96)
eval_105 = Evaluate(F="x*y", x=生物滞留设施_6, y=item_97)
eval_106 = Evaluate(F="x*y", x=绿地_7, y=item_98)
eval_107 = Evaluate(F="x*y", x=园路_9, y=item_99)
eval_108 = Evaluate(F="x*y", x=水面_10, y=item_100)
eval_109 = Evaluate(F="x*y", x=非机动车停车位_7, y=item_101)
eval_110 = Evaluate(F="x*y", x=其他硬质铺装_5, y=item_102)
sum_11 = Addition(
    A=eval_97,
    B=eval_98,
    C=eval_99,
    D=eval_100,
    E=eval_109,
    F=eval_106,
    G=eval_107,
    H=eval_101,
    I=eval_108,
    J=eval_110,
    K=eval_102,
    L=eval_103,
    M=eval_104,
    N=eval_105)
division_15 = Division(A=sum_11, B=area_57.Area)
multiplication_17 = Multiplication(A=下凹绿地_16, B=深度m)
multiplication_18 = Multiplication(A=植草沟_16, B=深度m_2)
multiplication_19 = Multiplication(A=雨水花园_16, B=深度m_3)
multiplication_20 = Multiplication(A=生物滞留设施_16, B=深度m_4)
multiplication_21 = Multiplication(A=multiplication_17, B=有效系数)
multiplication_22 = Multiplication(A=multiplication_18, B=有效系数_2)
multiplication_23 = Multiplication(A=multiplication_19, B=有效系数_3)
multiplication_24 = Multiplication(A=multiplication_20, B=有效系数_4)
下凹绿地控制雨水量_3 = Panel(multiplication_21)
植草沟控制雨水量_3 = Panel(multiplication_22)
雨水花园控制雨水量_3 = Panel(multiplication_23)
生物滞留设施控制雨水量_3 = Panel(multiplication_24)
sum_12 = Addition(A=下凹绿地控制雨水量_3, B=植草沟控制雨水量_3, C=雨水花园控制雨水量_3, D=生物滞留设施控制雨水量_3)

综合径流系数_9 = Panel(division_15)
eval_111 = Evaluate(F="10*x*y*z/10000", x=面积m2_9, y=综合径流系数_9, z=设计降雨量_mm)
雨水设计径流总量_m3_9 = Panel(eval_111)

matrix_33 = ConstructMatrix(Rows=13, Columns=1, Values=merge_57)
matrix_34 = DisplayMatrix(matrix_33)
merge_58 = Merge(
    Data1=硬质屋面,
    Data2=绿化屋面,
    Data3=道路,
    Data4=普通绿地,
    Data5=硬质铺装,
    Data6=透水铺装,
    Data7=生态停车位,
    Data8=水面,
    Data9=下凹绿地,
    Data10=植草沟,
    Data11=雨水花园,
    Data12=生物滞留设施,
    Data13=0,
    Data14=flatten(综合径流系数_9),
    Data15=flatten(雨水设计径流总量_m3_9))
lid控制雨水量_m3_3 = Panel(sum_12)
matrix_35 = ConstructMatrix(Rows=15, Columns=1, Values=merge_58)
matrix_36 = DisplayMatrix(matrix_35)

# ----
# 第三汇水分区
# 汇总
# 综合径流系数
# 雨水设计径流总量
面积m2_10 = Panel(area_82.Area)

# ----
# 下垫面面积统计
机动车_9 = StreamGate(Stream=机动车停车位_9, Gate=list_13)  # -> Target0, Target1, Target2, Target3, Target4
非机动车_9 = StreamGate(Stream=非机动车停车位_9, Gate=list_14)  # -> Target0, Target1, Target2, Target3, Target4
园路_23 = StreamGate(Stream=园路_12, Gate=list_16)  # -> Target0, Target1, Target2, Target3, Target4
广场_8 = StreamGate(Stream=活动广场_10, Gate=list_17)  # -> Target0, Target1, Target2, Target3, Target4
绿化屋面_34 = StreamGate(Stream=绿化屋面_16, Gate=list_2)  # -> Target0, Target1, Target2, Target3, Target4
merge_59 = Merge(Data1=机动车_9.Target3, Data2=非机动车_9.Target3, Data3=园路_23.Target3, Data4=广场_8.Target3)
merge_60 = Merge(Data1=机动车_9.Target2, Data2=非机动车_9.Target2, Data3=园路_23.Target2, Data4=广场_8.Target2)
merge_61 = Merge(Data1=机动车_9.Target4, Data2=非机动车_9.Target4, Data3=园路_23.Target4, Data4=广场_8.Target4)
addition_97 = Addition(A=下凹绿地_7, B=0)
addition_98 = Addition(A=雨水花园_7, B=0)
addition_99 = Addition(A=植草沟_7, B=0)
addition_100 = Addition(A=生物滞留设施_7, B=0)
addition_101 = Addition(A=硬质屋面_13, B=绿化屋面_34.Target0, C=0)
addition_102 = Addition(A=绿化屋面_34.Target1, B=0)
addition_103 = Addition(A=道路_13, B=0)
addition_104 = Addition(A=绿地_9, B=0)
ma_176 = MassAddition(Input=merge_60)  # -> Result, PartialResults
ma_177 = MassAddition(Input=merge_59)  # -> Result, PartialResults
ma_178 = MassAddition(Input=merge_61)  # -> Result, PartialResults
addition_105 = Addition(A=水面_13, B=0)
下凹绿地_17 = Panel(addition_97)
植草沟_17 = Panel(addition_99)
雨水花园_17 = Panel(addition_98)
生物滞留设施_17 = Panel(addition_100)
addition_106 = Addition(A=ma_177.Result, B=0)
addition_107 = Addition(A=ma_176.Result, B=其他硬质铺装_7)
addition_108 = Addition(A=ma_178.Result, B=0)
水面_25 = Panel(addition_105)
硬质屋面_25 = Panel(addition_101)
绿化屋面_35 = Panel(addition_102)
道路_25 = Panel(addition_103)
普通绿地_11 = Panel(addition_104)
透水铺装_16 = Panel(addition_106)
硬质铺装_11 = Panel(addition_107)
生态停车位_16 = Panel(addition_108)
merge_62 = Merge(
    Data1=flatten(硬质屋面_25),
    Data2=flatten(绿化屋面_35),
    Data3=flatten(道路_25),
    Data4=flatten(普通绿地_11),
    Data5=flatten(硬质铺装_11),
    Data6=flatten(透水铺装_16),
    Data7=flatten(生态停车位_16),
    Data8=flatten(水面_25),
    Data9=flatten(下凹绿地_17),
    Data10=flatten(植草沟_17),
    Data11=flatten(雨水花园_17),
    Data12=flatten(生物滞留设施_17),
    Data13=flatten(面积m2_10))

list_32 = ValueList({"硬质屋面": 0, "绿化屋面": 1, "硬质铺装": 2, "透水铺装": 3, "生态停车位": 4, "道路": 5, "普通绿地": 6, "水面": 7, "下凹绿地": 8, "植草沟": 9, "雨水花园": 10, "生物滞留设施": 11}, selected="硬质铺装")
item_103 = ListItem(List=merge, Index=list_10, Wrap=True)
item_104 = ListItem(List=merge, Index=list_11, Wrap=True)
item_105 = ListItem(List=merge, Index=list_12, Wrap=True)
item_106 = ListItem(List=merge, Index=list_13, Wrap=True)
item_107 = ListItem(List=merge, Index=list_17, Wrap=True)
item_108 = ListItem(List=merge, Index=list_19, Wrap=True)
item_109 = ListItem(List=merge, Index=list_20, Wrap=True)
item_110 = ListItem(List=merge, Index=list_22, Wrap=True)
item_111 = ListItem(List=merge, Index=list_21, Wrap=True)
item_112 = ListItem(List=merge, Index=list_15, Wrap=True)
item_113 = ListItem(List=merge, Index=list_16, Wrap=True)
item_114 = ListItem(List=merge, Index=list_18, Wrap=True)
item_115 = ListItem(List=merge, Index=list_14, Wrap=True)
item_116 = ListItem(List=merge, Index=list_32, Wrap=True)
eval_112 = Evaluate(F="x*y", x=硬质屋面_13, y=item_103)
eval_113 = Evaluate(F="x*y", x=绿化屋面_16, y=item_104)
eval_114 = Evaluate(F="x*y", x=道路_13, y=item_105)
eval_115 = Evaluate(F="x*y", x=机动车停车位_9, y=item_106)
eval_116 = Evaluate(F="x*y", x=活动广场_10, y=item_107)
eval_117 = Evaluate(F="x*y", x=下凹绿地_7, y=item_108)
eval_118 = Evaluate(F="x*y", x=植草沟_7, y=item_109)
eval_119 = Evaluate(F="x*y", x=雨水花园_7, y=item_110)
eval_120 = Evaluate(F="x*y", x=生物滞留设施_7, y=item_111)
eval_121 = Evaluate(F="x*y", x=绿地_9, y=item_112)
eval_122 = Evaluate(F="x*y", x=园路_12, y=item_113)
eval_123 = Evaluate(F="x*y", x=水面_13, y=item_114)
eval_124 = Evaluate(F="x*y", x=非机动车停车位_9, y=item_115)
eval_125 = Evaluate(F="x*y", x=其他硬质铺装_7, y=item_116)
sum_13 = Addition(
    A=eval_112,
    B=eval_113,
    C=eval_114,
    D=eval_115,
    E=eval_124,
    F=eval_121,
    G=eval_122,
    H=eval_116,
    I=eval_123,
    J=eval_125,
    K=eval_117,
    L=eval_118,
    M=eval_119,
    N=eval_120)
division_16 = Division(A=sum_13, B=area_82.Area)
multiplication_25 = Multiplication(A=下凹绿地_17, B=深度m)
multiplication_26 = Multiplication(A=植草沟_17, B=深度m_2)
multiplication_27 = Multiplication(A=雨水花园_17, B=深度m_3)
multiplication_28 = Multiplication(A=生物滞留设施_17, B=深度m_4)
multiplication_29 = Multiplication(A=multiplication_25, B=有效系数)
multiplication_30 = Multiplication(A=multiplication_26, B=有效系数_2)
multiplication_31 = Multiplication(A=multiplication_27, B=有效系数_3)
multiplication_32 = Multiplication(A=multiplication_28, B=有效系数_4)
下凹绿地控制雨水量_4 = Panel(multiplication_29)
植草沟控制雨水量_4 = Panel(multiplication_30)
雨水花园控制雨水量_4 = Panel(multiplication_31)
生物滞留设施控制雨水量_4 = Panel(multiplication_32)
sum_14 = Addition(A=下凹绿地控制雨水量_4, B=植草沟控制雨水量_4, C=雨水花园控制雨水量_4, D=生物滞留设施控制雨水量_4)

综合径流系数_10 = Panel(division_16)
eval_126 = Evaluate(F="10*x*y*z/10000", x=面积m2_10, y=综合径流系数_10, z=设计降雨量_mm)
雨水设计径流总量_m3_10 = Panel(eval_126)

matrix_37 = ConstructMatrix(Rows=13, Columns=1, Values=merge_62)
matrix_38 = DisplayMatrix(matrix_37)
merge_63 = Merge(
    Data1=硬质屋面,
    Data2=绿化屋面,
    Data3=道路,
    Data4=普通绿地,
    Data5=硬质铺装,
    Data6=透水铺装,
    Data7=生态停车位,
    Data8=水面,
    Data9=下凹绿地,
    Data10=植草沟,
    Data11=雨水花园,
    Data12=生物滞留设施,
    Data13=0,
    Data14=flatten(综合径流系数_10),
    Data15=flatten(雨水设计径流总量_m3_10))
lid控制雨水量_m3_4 = Panel(sum_14)
matrix_39 = ConstructMatrix(Rows=15, Columns=1, Values=merge_63)
matrix_40 = DisplayMatrix(matrix_39)

# ----
# 第四汇水分区
# 汇总
# 综合径流系数
# 雨水设计径流总量
面积m2_11 = Panel(area_106.Area)

# ----
# 下垫面面积统计
机动车_10 = StreamGate(Stream=机动车停车位_11, Gate=list_13)  # -> Target0, Target1, Target2, Target3, Target4
非机动车_10 = StreamGate(Stream=非机动车停车位_11, Gate=list_14)  # -> Target0, Target1, Target2, Target3, Target4
园路_24 = StreamGate(Stream=园路_15, Gate=list_16)  # -> Target0, Target1, Target2, Target3, Target4
广场_9 = StreamGate(Stream=活动广场_12, Gate=list_17)  # -> Target0, Target1, Target2, Target3, Target4
绿化屋面_36 = StreamGate(Stream=绿化屋面_20, Gate=list_2)  # -> Target0, Target1, Target2, Target3, Target4
merge_64 = Merge(Data1=机动车_10.Target3, Data2=非机动车_10.Target3, Data3=园路_24.Target3, Data4=广场_9.Target3)
merge_65 = Merge(Data1=机动车_10.Target2, Data2=非机动车_10.Target2, Data3=园路_24.Target2, Data4=广场_9.Target2)
merge_66 = Merge(Data1=机动车_10.Target4, Data2=非机动车_10.Target4, Data3=园路_24.Target4, Data4=广场_9.Target4)
addition_109 = Addition(A=硬质屋面_16, B=绿化屋面_36.Target0, C=0)
addition_110 = Addition(A=绿化屋面_36.Target1, B=0)
addition_111 = Addition(A=道路_16, B=0)
addition_112 = Addition(A=绿地_11, B=0)
addition_113 = Addition(A=生物滞留设施_8, B=0)
addition_114 = Addition(A=下凹绿地_8, B=0)
addition_115 = Addition(A=植草沟_8, B=0)
ma_179 = MassAddition(Input=merge_65)  # -> Result, PartialResults
addition_116 = Addition(A=雨水花园_8, B=0)
ma_180 = MassAddition(Input=merge_64)  # -> Result, PartialResults
ma_181 = MassAddition(Input=merge_66)  # -> Result, PartialResults
addition_117 = Addition(A=水面_16, B=0)
addition_118 = Addition(A=ma_180.Result, B=0)
addition_119 = Addition(A=ma_179.Result, B=其他硬质铺装_9)
addition_120 = Addition(A=ma_181.Result, B=0)
下凹绿地_18 = Panel(addition_114)
植草沟_18 = Panel(addition_115)
雨水花园_18 = Panel(addition_116)
生物滞留设施_18 = Panel(addition_113)
水面_26 = Panel(addition_117)
硬质屋面_26 = Panel(addition_109)
绿化屋面_37 = Panel(addition_110)
道路_26 = Panel(addition_111)
普通绿地_12 = Panel(addition_112)
透水铺装_17 = Panel(addition_118)
硬质铺装_12 = Panel(addition_119)
生态停车位_17 = Panel(addition_120)
merge_67 = Merge(
    Data1=flatten(硬质屋面_26),
    Data2=flatten(绿化屋面_37),
    Data3=flatten(道路_26),
    Data4=flatten(普通绿地_12),
    Data5=flatten(硬质铺装_12),
    Data6=flatten(透水铺装_17),
    Data7=flatten(生态停车位_17),
    Data8=flatten(水面_26),
    Data9=flatten(下凹绿地_18),
    Data10=flatten(植草沟_18),
    Data11=flatten(雨水花园_18),
    Data12=flatten(生物滞留设施_18),
    Data13=flatten(面积m2_11))

list_33 = ValueList({"硬质屋面": 0, "绿化屋面": 1, "硬质铺装": 2, "透水铺装": 3, "生态停车位": 4, "道路": 5, "普通绿地": 6, "水面": 7, "下凹绿地": 8, "植草沟": 9, "雨水花园": 10, "生物滞留设施": 11}, selected="硬质铺装")
item_117 = ListItem(List=merge, Index=list_19, Wrap=True)
item_118 = ListItem(List=merge, Index=list_20, Wrap=True)
item_119 = ListItem(List=merge, Index=list_22, Wrap=True)
item_120 = ListItem(List=merge, Index=list_21, Wrap=True)
item_121 = ListItem(List=merge, Index=list_10, Wrap=True)
item_122 = ListItem(List=merge, Index=list_11, Wrap=True)
item_123 = ListItem(List=merge, Index=list_12, Wrap=True)
item_124 = ListItem(List=merge, Index=list_13, Wrap=True)
item_125 = ListItem(List=merge, Index=list_17, Wrap=True)
item_126 = ListItem(List=merge, Index=list_15, Wrap=True)
item_127 = ListItem(List=merge, Index=list_16, Wrap=True)
item_128 = ListItem(List=merge, Index=list_18, Wrap=True)
item_129 = ListItem(List=merge, Index=list_14, Wrap=True)
item_130 = ListItem(List=merge, Index=list_33, Wrap=True)
eval_127 = Evaluate(F="x*y", x=下凹绿地_8, y=item_117)
eval_128 = Evaluate(F="x*y", x=植草沟_8, y=item_118)
eval_129 = Evaluate(F="x*y", x=雨水花园_8, y=item_119)
eval_130 = Evaluate(F="x*y", x=生物滞留设施_8, y=item_120)
eval_131 = Evaluate(F="x*y", x=硬质屋面_16, y=item_121)
eval_132 = Evaluate(F="x*y", x=绿化屋面_20, y=item_122)
eval_133 = Evaluate(F="x*y", x=道路_16, y=item_123)
eval_134 = Evaluate(F="x*y", x=机动车停车位_11, y=item_124)
eval_135 = Evaluate(F="x*y", x=活动广场_12, y=item_125)
eval_136 = Evaluate(F="x*y", x=绿地_11, y=item_126)
eval_137 = Evaluate(F="x*y", x=园路_15, y=item_127)
eval_138 = Evaluate(F="x*y", x=水面_16, y=item_128)
eval_139 = Evaluate(F="x*y", x=非机动车停车位_11, y=item_129)
eval_140 = Evaluate(F="x*y", x=其他硬质铺装_9, y=item_130)
sum_15 = Addition(
    A=eval_131,
    B=eval_132,
    C=eval_133,
    D=eval_134,
    E=eval_139,
    F=eval_136,
    G=eval_137,
    H=eval_135,
    I=eval_138,
    J=eval_140,
    K=eval_127,
    L=eval_128,
    M=eval_129,
    N=eval_130)
division_17 = Division(A=sum_15, B=area_106.Area)
multiplication_33 = Multiplication(A=下凹绿地_18, B=深度m)
multiplication_34 = Multiplication(A=植草沟_18, B=深度m_2)
multiplication_35 = Multiplication(A=雨水花园_18, B=深度m_3)
multiplication_36 = Multiplication(A=生物滞留设施_18, B=深度m_4)
multiplication_37 = Multiplication(A=multiplication_33, B=有效系数)
multiplication_38 = Multiplication(A=multiplication_34, B=有效系数_2)
multiplication_39 = Multiplication(A=multiplication_35, B=有效系数_3)
multiplication_40 = Multiplication(A=multiplication_36, B=有效系数_4)
下凹绿地控制雨水量_5 = Panel(multiplication_37)
植草沟控制雨水量_5 = Panel(multiplication_38)
雨水花园控制雨水量_5 = Panel(multiplication_39)
生物滞留设施控制雨水量_5 = Panel(multiplication_40)
sum_16 = Addition(A=下凹绿地控制雨水量_5, B=植草沟控制雨水量_5, C=雨水花园控制雨水量_5, D=生物滞留设施控制雨水量_5)

综合径流系数_11 = Panel(division_17)
eval_141 = Evaluate(F="10*x*y*z/10000", x=面积m2_11, y=综合径流系数_11, z=设计降雨量_mm)
雨水设计径流总量_m3_11 = Panel(eval_141)

matrix_41 = ConstructMatrix(Rows=13, Columns=1, Values=merge_67)
matrix_42 = DisplayMatrix(matrix_41)
merge_68 = Merge(
    Data1=硬质屋面,
    Data2=绿化屋面,
    Data3=道路,
    Data4=普通绿地,
    Data5=硬质铺装,
    Data6=透水铺装,
    Data7=生态停车位,
    Data8=水面,
    Data9=下凹绿地,
    Data10=植草沟,
    Data11=雨水花园,
    Data12=生物滞留设施,
    Data13=0,
    Data14=flatten(综合径流系数_11),
    Data15=flatten(雨水设计径流总量_m3_11))
lid控制雨水量_m3_5 = Panel(sum_16)
matrix_43 = ConstructMatrix(Rows=15, Columns=1, Values=merge_68)
matrix_44 = DisplayMatrix(matrix_43)

# ----
# 第五汇水分区
# 汇总
# 综合径流系数
# 雨水设计径流总量
面积m2_12 = Panel(area_123.Area)

# ----
# 下垫面面积统计
绿化屋面_38 = StreamGate(Stream=绿化屋面_24, Gate=list_2)  # -> Target0, Target1, Target2, Target3, Target4
机动车_11 = StreamGate(Stream=机动车停车位_13, Gate=list_13)  # -> Target0, Target1, Target2, Target3, Target4
非机动车_11 = StreamGate(Stream=非机动车停车位_13, Gate=list_14)  # -> Target0, Target1, Target2, Target3, Target4
园路_25 = StreamGate(Stream=园路_18, Gate=list_16)  # -> Target0, Target1, Target2, Target3, Target4
广场_10 = StreamGate(Stream=活动广场_14, Gate=list_17)  # -> Target0, Target1, Target2, Target3, Target4
merge_69 = Merge(Data1=机动车_11.Target3, Data2=非机动车_11.Target3, Data3=园路_25.Target3, Data4=广场_10.Target3)
merge_70 = Merge(Data1=机动车_11.Target2, Data2=非机动车_11.Target2, Data3=园路_25.Target2, Data4=广场_10.Target2)
merge_71 = Merge(Data1=机动车_11.Target4, Data2=非机动车_11.Target4, Data3=园路_25.Target4, Data4=广场_10.Target4)
addition_121 = Addition(A=硬质屋面_19, B=绿化屋面_38.Target0, C=0)
addition_122 = Addition(A=绿化屋面_38.Target1, B=0)
addition_123 = Addition(A=道路_19, B=0)
addition_124 = Addition(A=绿地_13, B=0)
addition_125 = Addition(A=下凹绿地_9, B=0)
ma_182 = MassAddition(Input=merge_70)  # -> Result, PartialResults
addition_126 = Addition(A=水面_19, B=0)
addition_127 = Addition(A=雨水花园_9, B=0)
ma_183 = MassAddition(Input=merge_69)  # -> Result, PartialResults
addition_128 = Addition(A=生物滞留设施_9, B=0)
addition_129 = Addition(A=植草沟_9, B=0)
ma_184 = MassAddition(Input=merge_71)  # -> Result, PartialResults
addition_130 = Addition(A=ma_183.Result, B=0)
addition_131 = Addition(A=ma_182.Result, B=其他硬质铺装_11)
addition_132 = Addition(A=ma_184.Result, B=0)
下凹绿地_19 = Panel(addition_125)
植草沟_19 = Panel(addition_129)
雨水花园_19 = Panel(addition_127)
生物滞留设施_19 = Panel(addition_128)
水面_27 = Panel(addition_126)
硬质屋面_27 = Panel(addition_121)
绿化屋面_39 = Panel(addition_122)
道路_27 = Panel(addition_123)
普通绿地_13 = Panel(addition_124)
透水铺装_18 = Panel(addition_130)
硬质铺装_13 = Panel(addition_131)
生态停车位_18 = Panel(addition_132)
merge_72 = Merge(
    Data1=flatten(硬质屋面_27),
    Data2=flatten(绿化屋面_39),
    Data3=flatten(道路_27),
    Data4=flatten(普通绿地_13),
    Data5=flatten(硬质铺装_13),
    Data6=flatten(透水铺装_18),
    Data7=flatten(生态停车位_18),
    Data8=flatten(水面_27),
    Data9=flatten(下凹绿地_19),
    Data10=flatten(植草沟_19),
    Data11=flatten(雨水花园_19),
    Data12=flatten(生物滞留设施_19),
    Data13=flatten(面积m2_12))

list_34 = ValueList({"硬质屋面": 0, "绿化屋面": 1, "硬质铺装": 2, "透水铺装": 3, "生态停车位": 4, "道路": 5, "普通绿地": 6, "水面": 7, "下凹绿地": 8, "植草沟": 9, "雨水花园": 10, "生物滞留设施": 11}, selected="硬质铺装")
item_131 = ListItem(List=merge, Index=list_19, Wrap=True)
item_132 = ListItem(List=merge, Index=list_20, Wrap=True)
item_133 = ListItem(List=merge, Index=list_22, Wrap=True)
item_134 = ListItem(List=merge, Index=list_21, Wrap=True)
item_135 = ListItem(List=merge, Index=list_10, Wrap=True)
item_136 = ListItem(List=merge, Index=list_11, Wrap=True)
item_137 = ListItem(List=merge, Index=list_12, Wrap=True)
item_138 = ListItem(List=merge, Index=list_13, Wrap=True)
item_139 = ListItem(List=merge, Index=list_17, Wrap=True)
item_140 = ListItem(List=merge, Index=list_15, Wrap=True)
item_141 = ListItem(List=merge, Index=list_16, Wrap=True)
item_142 = ListItem(List=merge, Index=list_18, Wrap=True)
item_143 = ListItem(List=merge, Index=list_14, Wrap=True)
item_144 = ListItem(List=merge, Index=list_34, Wrap=True)
eval_142 = Evaluate(F="x*y", x=下凹绿地_9, y=item_131)
eval_143 = Evaluate(F="x*y", x=植草沟_9, y=item_132)
eval_144 = Evaluate(F="x*y", x=雨水花园_9, y=item_133)
eval_145 = Evaluate(F="x*y", x=生物滞留设施_9, y=item_134)
eval_146 = Evaluate(F="x*y", x=硬质屋面_19, y=item_135)
eval_147 = Evaluate(F="x*y", x=绿化屋面_24, y=item_136)
eval_148 = Evaluate(F="x*y", x=道路_19, y=item_137)
eval_149 = Evaluate(F="x*y", x=机动车停车位_13, y=item_138)
eval_150 = Evaluate(F="x*y", x=活动广场_14, y=item_139)
eval_151 = Evaluate(F="x*y", x=绿地_13, y=item_140)
eval_152 = Evaluate(F="x*y", x=园路_18, y=item_141)
eval_153 = Evaluate(F="x*y", x=水面_19, y=item_142)
eval_154 = Evaluate(F="x*y", x=非机动车停车位_13, y=item_143)
eval_155 = Evaluate(F="x*y", x=其他硬质铺装_11, y=item_144)
sum_17 = Addition(
    A=eval_146,
    B=eval_147,
    C=eval_148,
    D=eval_149,
    E=eval_154,
    F=eval_151,
    G=eval_152,
    H=eval_150,
    I=eval_153,
    J=eval_155,
    K=eval_142,
    L=eval_143,
    M=eval_144,
    N=eval_145)
division_18 = Division(A=sum_17, B=area_123.Area)
multiplication_41 = Multiplication(A=下凹绿地_19, B=深度m)
multiplication_42 = Multiplication(A=植草沟_19, B=深度m_2)
multiplication_43 = Multiplication(A=雨水花园_19, B=深度m_3)
multiplication_44 = Multiplication(A=生物滞留设施_19, B=深度m_4)
multiplication_45 = Multiplication(A=multiplication_41, B=有效系数)
multiplication_46 = Multiplication(A=multiplication_42, B=有效系数_2)
multiplication_47 = Multiplication(A=multiplication_43, B=有效系数_3)
multiplication_48 = Multiplication(A=multiplication_44, B=有效系数_4)
下凹绿地控制雨水量_6 = Panel(multiplication_45)
植草沟控制雨水量_6 = Panel(multiplication_46)
雨水花园控制雨水量_6 = Panel(multiplication_47)
生物滞留设施控制雨水量_6 = Panel(multiplication_48)
sum_18 = Addition(A=下凹绿地控制雨水量_6, B=植草沟控制雨水量_6, C=雨水花园控制雨水量_6, D=生物滞留设施控制雨水量_6)

综合径流系数_12 = Panel(division_18)
eval_156 = Evaluate(F="10*x*y*z/10000", x=面积m2_12, y=综合径流系数_12, z=设计降雨量_mm)
雨水设计径流总量_m3_12 = Panel(eval_156)

matrix_45 = ConstructMatrix(Rows=13, Columns=1, Values=merge_72)
matrix_46 = DisplayMatrix(matrix_45)
merge_73 = Merge(
    Data1=硬质屋面,
    Data2=绿化屋面,
    Data3=道路,
    Data4=普通绿地,
    Data5=硬质铺装,
    Data6=透水铺装,
    Data7=生态停车位,
    Data8=水面,
    Data9=下凹绿地,
    Data10=植草沟,
    Data11=雨水花园,
    Data12=生物滞留设施,
    Data13=0,
    Data14=flatten(综合径流系数_12),
    Data15=flatten(雨水设计径流总量_m3_12))
lid控制雨水量_m3_6 = Panel(sum_18)
matrix_47 = ConstructMatrix(Rows=15, Columns=1, Values=merge_73)
matrix_48 = DisplayMatrix(matrix_47)
